# Dynamo graph 078_09_length_conduit.dyn "length conduit" (Dynamo 2.10.1.3976)

# group: Получили все короба
code_block = CodeBlock { Category.ByName("OST_Conduit"); }
all_elements_of_category = ElementsOfCategory(Category=code_block)

parameters = Element.Parameters(element=all_elements_of_category)

# group: Получили все соединительные детали коробов
code_block_2 = CodeBlock { Category.ByName("OST_ConduitFitting"); }
all_elements_of_category_2 = ElementsOfCategory(Category=code_block_2)

# group: Отфильтровали Хомуты и Шпильки
code_block_3 = CodeBlock(a=all_elements_of_category_2) { a.Name; }
code_block_4 = CodeBlock { "Хомут"; }
contains = String.Contains(str=code_block_3, searchFor=code_block_4)
filterByBoolMask = List.FilterByBoolMask(list=all_elements_of_category_2, mask=contains)
code_block_5 = CodeBlock(a=filterByBoolMask.out) { a.Name; }
code_block_6 = CodeBlock { "Шпилька"; }
contains_2 = String.Contains(str=code_block_5, searchFor=code_block_6)
filterByBoolMask_2 = List.FilterByBoolMask(list=filterByBoolMask.out, mask=contains_2)

# group: Сгруппировав по "БУДОВА Группа" проссумировали длины
code_block_7 = CodeBlock(w=filterByBoolMask_2.out) { w; }
code_block_8 = CodeBlock { "BDV_E000_Длина линии по внешнему радиусу"; }
getParameterValueByName = Element.GetParameterValueByName(element=code_block_7, parameterName=code_block_8)
code_block_9 = CodeBlock { "БУДОВА_Группа"; }
getParameterValueByName_2 = Element.GetParameterValueByName(element=code_block_7, parameterName=code_block_9)

code_block_10 = CodeBlock(a=getParameterValueByName_2) { a==""? "Не присвоена":a; }

# group (continued): Сгруппировав по "БУДОВА Группа" проссумировали длины
sortByKey = List.SortByKey(list=getParameterValueByName, keys=code_block_10)
code_block_11 = CodeBlock(w=sortByKey.sortedKeys) { w; }
code_block_12 = CodeBlock(w=sortByKey.sortedList) { w; }
groupByKey = List.GroupByKey(list=sortByKey.sortedList, keys=sortByKey.sortedKeys)
code_block_13 = CodeBlock(w=groupByKey.groups) { w; }
code_block_14 = CodeBlock(w=groupByKey.unique_keys) { w; }
sum = Math.Sum(values=groupByKey.groups@@L2)

code_block_15 = CodeBlock { "БУДОВА_Количество_Фиктивное"; }

# group: Короба. Длина и имя группы
code_block_16 = CodeBlock(w=all_elements_of_category) { w; }
code_block_17 = CodeBlock { "Длина"; }
getParameterValueByName_3 = Element.GetParameterValueByName(element=code_block_16, parameterName=code_block_17)
code_block_18 = CodeBlock { "БУДОВА_Группа"; }
getParameterValueByName_4 = Element.GetParameterValueByName(element=code_block_16, parameterName=code_block_18)
code_block_19 = CodeBlock(a=getParameterValueByName_4) { a==""? "Не присвоена":a; }

# group: Получили группы, которых нет в соединительных деталях
uniqueItems = List.UniqueItems(list=code_block_19)
setDifference = List.SetDifference(list1=uniqueItems, list2=code_block_14)

# group: Создали нулевые значения длин для недостающих групп
code_block_20 = CodeBlock { 0; }
count = List.Count(list=setDifference)
cycle = List.Cycle(list=code_block_20, amount=count)

# group: Объединили списки
list_create = List.Create(item0=code_block_14, item1=setDifference)
flatten = List.Flatten(list=list_create)
list_create_2 = List.Create(item0=sum, item1=cycle)
flatten_2 = List.Flatten(list=list_create_2)

# group: для ИНФО сгруппировав по "БУДОВА Группа" проссумировали длины коробов каждой группы (без длин соединительных деталей)
code_block_21 = CodeBlock(w=all_elements_of_category) { w; }
code_block_22 = CodeBlock { "Длина"; }
getParameterValueByName_5 = Element.GetParameterValueByName(element=code_block_21, parameterName=code_block_22)
code_block_23 = CodeBlock { "БУДОВА_Группа"; }
getParameterValueByName_6 = Element.GetParameterValueByName(element=code_block_21, parameterName=code_block_23)
code_block_24 = CodeBlock(a=getParameterValueByName_6) { a==""? "Не присвоена":a; }
sortByKey_2 = List.SortByKey(list=getParameterValueByName_5, keys=code_block_24)
groupByKey_2 = List.GroupByKey(list=sortByKey_2.sortedList, keys=sortByKey_2.sortedKeys)
code_block_25 = CodeBlock(w=sortByKey_2.sortedKeys) { w; }
code_block_26 = CodeBlock(w=sortByKey_2.sortedList) { w; }
code_block_27 = CodeBlock(w=groupByKey_2.unique_keys) { w; }
code_block_28 = CodeBlock(w=groupByKey_2.groups) { w; }
sum_2 = Math.Sum(values=groupByKey_2.groups@@L2)

# group: Число элементов (прямых коробов без соед. деталей) в группе разделили на суммарную длину всех соединительных деталей в этой группе чтобы каждому коробу добавить длину
count_2 = List.Count(list=groupByKey_2.groups@L2)
code_block_29 = CodeBlock(a=flatten_2, b=count_2) { a/b; }

# group: В каждом имени группы проссумировали длины соединительных деталей, затем разделили на число коробов в этой же группе и добавили к длине каждого короба число
byKeysValues = DesignScript.Builtin.Dictionary.ByKeysValues(keys=flatten, values=code_block_29)
valueAtKey = DesignScript.Builtin.Dictionary.ValueAtKey(dictionary=byKeysValues, key=code_block_19)
code_block_30 = CodeBlock(korob=getParameterValueByName_3, soediniteli=valueAtKey) { korob+soediniteli; }

setParameterByName = Element.SetParameterByName(element=all_elements_of_category, parameterName=code_block_15, value=code_block_30)

# group: ПРОВЕРКА
getParameterValueByName_7 = Element.GetParameterValueByName(element=setParameterByName, parameterName=code_block_15)
type = Object.Type(obj=getParameterValueByName_7)
code_block_31 = CodeBlock(a=getParameterValueByName_7) { Sum(a)/1000; }
round = Math.Round(number=code_block_31)

type_2 = Object.Type(obj=getParameterValueByName)
