# Dynamo graph 078_09_level.dyn "select_active_level" (Dynamo 2.10.1.3976)

code_block = CodeBlock { ["первый", "второй", "третий"]; }
code_block_2 = CodeBlock { [1,2,3]; }
byKeysValues = DesignScript.Builtin.Dictionary.ByKeysValues(keys=code_block, values=code_block_2)
keys = DesignScript.Builtin.Dictionary.Keys(dictionary=byKeysValues)
values = DesignScript.Builtin.Dictionary.Values(dictionary=byKeysValues)
code_block_3 = CodeBlock(a=keys, b=values) { a + ": " + b; }
watch = Watch(code_block_3)
