# Dynamo graph Home.dyn (Dynamo 2.10.1.3976)

string = StringInput("asdf,dfg,hjk")
python_script = Python(IN[0]=string)  # IronPython2
# ---------- python_script.python (2 lines) ----------
str1 = IN[0]
OUT = str1[(str1.find(',')+1):]
# ----------------------------------------
code_block = CodeBlock()
# ---------- code_block.designscript (12 lines) ----------
[["asdf,1dfg,hjk",
"asdf,2dfg,hjk",
"asdf,3dfg,hjk",
"asdf,4dfg,hjk",
"asdf,5dfg,hjk"
],
["asdf,6dfg,hjk",
"asdf,7dfg,hjk",
"asdf,8dfg,hjk",
"asdf,9dfg,hjk",
"asdf,10dfg,hjk"
]];
# ----------------------------------------
python_script_2 = Python(IN[0]=code_block)  # IronPython2
# ---------- python_script_2.python (1 lines) ----------
OUT = [[str1[(str1.find(',')+1):] for str1 in list2] for list2 in IN[0]]
# ----------------------------------------
