# Dynamo graph BDV_E000 Переименование цепей.dyn (Dynamo 2.10.1.3976)

# group: Категория Электрические приборы
категория_электрические_приборы = CodeBlock { Category.ByName("OST_ElectricalFixtures"); }
all_elements_of_category = ElementsOfCategory(Category=категория_электрические_приборы)

# group: Отобрали Эл.приборы, у которых есть уровень
code_block = CodeBlock(w=all_elements_of_category) { w; }
code_block_2 = CodeBlock { "Уровень"; }
getParameterValueByName = Element.GetParameterValueByName(element=code_block, parameterName=code_block_2)
code_block_3 = CodeBlock(a=getParameterValueByName) { a==""?false:true; }
filterByBoolMask = List.FilterByBoolMask(list=code_block, mask=code_block_3)

# group: Отобрали ЯТП и розетки
code_block_4 = CodeBlock(a=filterByBoolMask.in) { a.Name; }
code_block_5 = CodeBlock(a=code_block_4) { a=="BDV_E000_ЯТП-0,25"; }
code_block_6 = CodeBlock { "озетка"; }
contains = String.Contains(str=code_block_4, searchFor=code_block_6)
a_или_б = CodeBlock(a=code_block_5, b=contains) { a || b; }
filterByBoolMask_2 = List.FilterByBoolMask(list=filterByBoolMask.in, mask=a_или_б)

# group: Категория Выключатели
категория_выключатели = CodeBlock { Category.ByName("OST_LightingDevices"); }
all_elements_of_category_2 = ElementsOfCategory(Category=категория_выключатели)

join = List.Join(list0=filterByBoolMask_2.in, list1=all_elements_of_category_2)

# group: Из "Имя панели" записали в "БУДОВА_Группа"для ЯТП, розеток и выключателей
code_block_7 = CodeBlock(w=join) { w; }
code_block_8 = CodeBlock { "БУДОВА_Группа"; }
code_block_9 = CodeBlock { "Панель"; }
getParameterValueByName_2 = Element.GetParameterValueByName(element=code_block_7, parameterName=code_block_9)
code_block_10 = CodeBlock { "."; }
lastIndexOf = String.LastIndexOf(str=getParameterValueByName_2, searchFor=code_block_10)
точку_не_удаляем = CodeBlock(b=lastIndexOf) { b; }
length = String.Length(str=getParameterValueByName_2)
сколько_разрядов_вместе_с_точкой = CodeBlock(a=length, b=точку_не_удаляем) { a-b; }
remove = String.Remove(string=getParameterValueByName_2, startIndex=точку_не_удаляем, count=сколько_разрядов_вместе_с_точкой)
setParameterByName = Element.SetParameterByName(element=code_block_7, parameterName=code_block_8, value=remove)
getParameterValueByName_3 = Element.GetParameterValueByName(element=setParameterByName, parameterName=code_block_8)

code_block_11 = CodeBlock { гр; }  # unwired: гр
code_block_12 = CodeBlock { В; }  # unwired: В
code_block_13 = CodeBlock { ЩЭ; }  # unwired: ЩЭ
code_block_14 = CodeBlock { Л; }  # unwired: Л
code_block_15 = CodeBlock { Н; }  # unwired: Н
code_block_16 = CodeBlock { ГК; }  # unwired: ГК
code_block_17 = CodeBlock { П; }  # unwired: П
code_block_18 = CodeBlock { Р; }  # unwired: Р
join_2 = List.Join(list0=code_block_11, list1=code_block_12, list2=code_block_13, list3=code_block_14, list4=code_block_15, list5=code_block_16, list6=code_block_17, list7=code_block_18)  # frozen

# group: Выбор "Обозначения цепей" Здесь устанавливаем, что цепи, идущие от этого электрооборудования (этих панелей), будут с префиксами
code_block_19 = CodeBlock { "Обозначение цепей"; }
getParameterValueByName_4 = Element.GetParameterValueByName(element=join_2, parameterName=code_block_19)
# note: "С префиксами" это 0
# "Имя панели" это 2
# Судя по всему это индекс, под которым обозначения цепей идут в выпадающем списке
code_block_20 = CodeBlock { 0; }
setParameterByName_2 = Element.SetParameterByName(element=join_2, parameterName=code_block_19, value=code_block_20)

# group: Панель (категория Электрооборудование)
категория_электрические_приборы_2 = CodeBlock { Category.ByName("OST_ElectricalEquipment"); }
all_elements_of_category_3 = ElementsOfCategory(Category=категория_электрические_приборы_2)

# group: Отобрали электрообородувание, у которого есть уровень
code_block_21 = CodeBlock(w=all_elements_of_category_3) { w; }
code_block_22 = CodeBlock { "Уровень"; }
getParameterValueByName_5 = Element.GetParameterValueByName(element=code_block_21, parameterName=code_block_22)
code_block_23 = CodeBlock(a=getParameterValueByName_5) { a==""?false:true; }
filterByBoolMask_3 = List.FilterByBoolMask(list=code_block_21, mask=code_block_23)

code_block_24 = CodeBlock(w=filterByBoolMask_3.in) { w; }
code_block_25 = CodeBlock { "Имя панели"; }
getParameterValueByName_6 = Element.GetParameterValueByName(element=code_block_24, parameterName=code_block_25)

# group: Отобрали панели, которые в "Имя панели" содержат "гр" "В" "ЩЭ" "Л" "Н" "ГК" "П" "Р"
python_script = Python(IN[0]=getParameterValueByName_6)  # IronPython2
# ---------- python_script.python (30 lines) ----------
# Загрузить стандартную библиотеку Python и библиотеку DesignScript
import sys
import clr
clr.AddReference('ProtoGeometry')
from Autodesk.DesignScript.Geometry import *

names_panel = IN[0]

list = []
for name in names_panel:
    if name.find("гр") != -1:
        list.append(True)
    elif name.find("В") != -1:
        list.append(True)
    elif name.find("ЩЭ") != -1:
        list.append(True)        
    elif name.find("Л") != -1:
        list.append(True)        
    elif name.find("Н") != -1:
        list.append(True)        
    elif name.find("ГК") != -1:
        list.append(True)
    elif name.find("П") != -1:
        list.append(True)
    elif name.find("Р") != -1:
        list.append(True)   
    else:
        list.append(False)

OUT = list
# ----------------------------------------
filterByBoolMask_4 = List.FilterByBoolMask(list=code_block_24, mask=python_script)

# group: Переименование префикса цепи в панелях в соответсвии с именем панели. (Панели содержаие в "Имя панели": "гр" "В" "ЩЭ" "Л" "Н" "ГК" "П" "Р")
code_block_26 = CodeBlock(w=filterByBoolMask_4.in) { w; }
code_block_27 = CodeBlock { "Префикс цепи"; }
getParameterValueByName_7 = Element.GetParameterValueByName(element=code_block_26, parameterName=code_block_27)
если_в_строке_пустота_строка_не = CodeBlock(a=getParameterValueByName_7) { a==""?"X":a; }  # "если в строке пустота (строка не может иметь нулевую длину)"
code_block_28 = CodeBlock { "Имя панели"; }
getParameterValueByName_8 = Element.GetParameterValueByName(element=code_block_26, parameterName=code_block_28)
code_block_29 = CodeBlock(a=getParameterValueByName_8) { a+"эт_цепь"; }
replace = String.Replace(string=если_в_строке_пустота_строка_не, searchFor=если_в_строке_пустота_строка_не, replaceWith=code_block_29)
setParameterByName_3 = Element.SetParameterByName(element=code_block_26, parameterName=code_block_27, value=replace)

# group: Выбор диапазона уровней
нижний = Levels()  # nothing selected; frozen
верхний = Levels()  # nothing selected; frozen

# group: Отобрали на нужном нам уровне
code_block_30 = CodeBlock { w; }  # frozen; unwired: w
code_block_31 = CodeBlock { "Уровень"; }
getParameterValueByName_9 = Element.GetParameterValueByName(element=code_block_30, parameterName=code_block_31)
elevation = Level.Elevation(level=getParameterValueByName_9)
code_block_32 = CodeBlock(a=elevation, niz=нижний, verh=верхний) { a>=niz.Elevation && a<=verh.Elevation; }
filterByBoolMask_5 = List.FilterByBoolMask(list=code_block_30, mask=code_block_32)

# group: Отобрали панели, которые в "Имя панели" содержат "М"
code_block_33 = CodeBlock { "М"; }
contains_2 = String.Contains(str=getParameterValueByName_6, searchFor=code_block_33)
filterByBoolMask_6 = List.FilterByBoolMask(list=code_block_24, mask=contains_2)

# group: "Имя панели" содержат "М" ///ВСЕ ЭТО ОСТАВЛЕНО НА ВСЯКИЙ СЛУЧАЙ///
code_block_34 = CodeBlock(М=filterByBoolMask_6.in) { М; }
code_block_35 = CodeBlock(М=code_block_34) { М; }  # frozen

# group: Уровни панелей содержащих М
code_block_36 = CodeBlock { "Уровень"; }
getParameterValueByName_10 = Element.GetParameterValueByName(element=code_block_35, parameterName=code_block_36)
code_block_37 = CodeBlock(a=getParameterValueByName_10) { a.Name; }
уровни_от_1_до_9 = CodeBlock(w=code_block_37) { w; }

# group: Удаление всего что до знака "/"
code_block_38 = CodeBlock { "Имя панели"; }
getParameterValueByName_11 = Element.GetParameterValueByName(element=code_block_35, parameterName=code_block_38)
code_block_39 = CodeBlock { 0; }
code_block_40 = CodeBlock { "/"; }
indexOf = String.IndexOf(str=getParameterValueByName_11, searchFor=code_block_40)
remove_2 = String.Remove(string=getParameterValueByName_11, startIndex=code_block_39, count=indexOf)

# group: Имена магистралей
code_block_41 = CodeBlock { 0; }
code_block_42 = CodeBlock { "М1"; }
уровень_1 = CodeBlock(a=уровни_от_1_до_9, МN=code_block_42) { String.Contains(a, "L0100", false)? МN+"-1":""; }
insert = String.Insert(index=code_block_41, toInsert=уровень_1)  # unwired: string
уровень_2 = CodeBlock(a=уровни_от_1_до_9, МN=code_block_42) { String.Contains(a, "L0200", false)? МN+"-2":""; }
insert_2 = String.Insert(index=code_block_41, toInsert=уровень_2)  # unwired: string
уровень_3 = CodeBlock(a=уровни_от_1_до_9, МN=code_block_42) { String.Contains(a, "L0300", false)? МN+"-3":""; }
insert_3 = String.Insert(index=code_block_41, toInsert=уровень_3)  # unwired: string
code_block_43 = CodeBlock { "М2"; }
уровень_4 = CodeBlock(a=уровни_от_1_до_9, МN=code_block_43) { String.Contains(a, "L0400", false)? МN+"-4":""; }
insert_4 = String.Insert(index=code_block_41, toInsert=уровень_4)  # unwired: string
уровень_5 = CodeBlock(a=уровни_от_1_до_9, МN=code_block_43) { String.Contains(a, "L0500", false)? МN+"-5":""; }
insert_5 = String.Insert(index=code_block_41, toInsert=уровень_5)  # unwired: string
уровень_6 = CodeBlock(a=уровни_от_1_до_9, МN=code_block_43) { String.Contains(a, "L0600", false)? МN+"-6":""; }
insert_6 = String.Insert(index=code_block_41, toInsert=уровень_6)  # unwired: string
code_block_44 = CodeBlock { "М3"; }
уровень_7 = CodeBlock(a=уровни_от_1_до_9, МN=code_block_44) { String.Contains(a, "L0700", false)? МN+"-7":""; }
insert_7 = String.Insert(index=code_block_41, toInsert=уровень_7)  # unwired: string
уровень_8 = CodeBlock(a=уровни_от_1_до_9, МN=code_block_44) { String.Contains(a, "L0800", false)? МN+"-8":""; }
insert_8 = String.Insert(index=code_block_41, toInsert=уровень_8)  # unwired: string
уровень_9 = CodeBlock(a=уровни_от_1_до_9, МN=code_block_44) { String.Contains(a, "L0900", false)? МN+"-9":""; }
insert_9 = String.Insert(index=code_block_41, toInsert=уровень_9)  # unwired: string
code_block_45 = CodeBlock { "М4"; }
уровень_10 = CodeBlock(a=уровни_от_1_до_9, МN=code_block_45) { String.Contains(a, "L1000", false)? МN+"-10":""; }
insert_10 = String.Insert(index=code_block_41, toInsert=уровень_10)  # unwired: string
уровень_11 = CodeBlock(a=уровни_от_1_до_9, МN=code_block_45) { String.Contains(a, "L1100", false)? МN+"-11":""; }
insert_11 = String.Insert(index=code_block_41, toInsert=уровень_11)  # unwired: string
уровень_12 = CodeBlock(a=уровни_от_1_до_9, МN=code_block_45) { String.Contains(a, "L1200", false)? МN+"-12":""; }
insert_12 = String.Insert(index=code_block_41, toInsert=уровень_12)  # unwired: string
code_block_46 = CodeBlock { "М5"; }
уровень_13 = CodeBlock(a=уровни_от_1_до_9, МN=code_block_46) { String.Contains(a, "L1300", false)? МN+"-13":""; }
insert_13 = String.Insert(index=code_block_41, toInsert=уровень_13)  # unwired: string
уровень_14 = CodeBlock(a=уровни_от_1_до_9, МN=code_block_46) { String.Contains(a, "L1400", false)? МN+"-14":""; }
insert_14 = String.Insert(index=code_block_41, toInsert=уровень_14)  # unwired: string
уровень_15 = CodeBlock(a=уровни_от_1_до_9, МN=code_block_46) { String.Contains(a, "L1500", false)? МN+"-15":""; }
insert_15 = String.Insert(index=code_block_41, toInsert=уровень_15)  # unwired: string
code_block_47 = CodeBlock { "М6"; }
уровень_16 = CodeBlock(a=уровни_от_1_до_9, МN=code_block_47) { String.Contains(a, "L1600", false)? МN+"-16":""; }
insert_16 = String.Insert(index=code_block_41, toInsert=уровень_16)  # unwired: string
уровень_17 = CodeBlock(a=уровни_от_1_до_9, МN=code_block_47) { String.Contains(a, "L1700", false)? МN+"-17":""; }
insert_17 = String.Insert(index=code_block_41, toInsert=уровень_17)  # unwired: string
уровень_18 = CodeBlock(a=уровни_от_1_до_9, МN=code_block_47) { String.Contains(a, "L1800", false)? МN+"-18":""; }
insert_18 = String.Insert(index=code_block_41, toInsert=уровень_18)  # unwired: string
code_block_48 = CodeBlock { "М7"; }
уровень_19 = CodeBlock(a=уровни_от_1_до_9, МN=code_block_48) { String.Contains(a, "L1900", false)? МN+"-19":""; }
insert_19 = String.Insert(index=code_block_41, toInsert=уровень_19)  # unwired: string
уровень_20 = CodeBlock(a=уровни_от_1_до_9, МN=code_block_48) { String.Contains(a, "L2000", false)? МN+"-20":""; }
insert_20 = String.Insert(index=code_block_41, toInsert=уровень_20)  # unwired: string
уровень_21 = CodeBlock(a=уровни_от_1_до_9, МN=code_block_48) { String.Contains(a, "L2100", false)? МN+"-21":""; }
insert_21 = String.Insert(index=code_block_41, toInsert=уровень_21)  # unwired: string
code_block_49 = CodeBlock { "М8"; }
уровень_22 = CodeBlock(a=уровни_от_1_до_9, МN=code_block_49) { String.Contains(a, "L2200", false)? МN+"-22":""; }
insert_22 = String.Insert(index=code_block_41, toInsert=уровень_22)  # unwired: string
уровень_23 = CodeBlock(a=уровни_от_1_до_9, МN=code_block_49) { String.Contains(a, "L2300", false)? МN+"-23":""; }
insert_23 = String.Insert(index=code_block_41, toInsert=уровень_23)  # unwired: string
уровень_24 = CodeBlock(a=уровни_от_1_до_9, МN=code_block_49) { String.Contains(a, "L2400", false)? МN+"-24":""; }
insert_24 = String.Insert(index=code_block_41, toInsert=уровень_24)  # unwired: string
code_block_50 = CodeBlock { "М9"; }
уровень_25 = CodeBlock(a=уровни_от_1_до_9, МN=code_block_50) { String.Contains(a, "LT100", false)? МN+"-25":""; }
insert_25 = String.Insert(index=code_block_41, toInsert=уровень_25)  # unwired: string
уровень_26 = CodeBlock(a=уровни_от_1_до_9, МN=code_block_50) { String.Contains(a, "LR100", false)? МN+"-26":""; }
insert_26 = String.Insert(index=code_block_41, toInsert=уровень_26)  # unwired: string
уровень_26_2 = CodeBlock(a=уровни_от_1_до_9, МN=code_block_50) { String.Contains(a, "LR400", false)? МN+"-26_2":""; }
insert_27 = String.Insert(index=code_block_41, toInsert=уровень_26_2)  # unwired: string
function_compose = ComposeFunctions(func0=insert, func1=insert_2, func2=insert_3, func3=insert_4, func4=insert_5, func5=insert_6, func6=insert_7, func7=insert_8, func8=insert_9, function9=insert_10, function10=insert_11, function11=insert_12, function12=insert_13, function13=insert_14, function14=insert_15, function15=insert_16, function16=insert_17, function17=insert_18, function18=insert_19, function19=insert_20, function20=insert_21, function21=insert_22, function22=insert_23, function23=insert_24, function24=insert_25, function25=insert_26, function26=insert_27)
function_apply = ApplyFunction(func=function_compose, arg1=remove_2)

# group: Присвоили панели новое имя, в зависимости от уровня
code_block_51 = CodeBlock { "Имя панели"; }
setParameterByName_4 = Element.SetParameterByName(element=code_block_35, parameterName=code_block_51, value=function_apply)

code_block_52 = CodeBlock { "БУДОВА_Группа"; }
setParameterByName_5 = Element.SetParameterByName(element=setParameterByName_4, parameterName=code_block_52, value=function_apply)

# group: Из уровней заполнили "БУДОВА_Уровень оборудования", "БУДОВА_Этаж" для ЯТП, розеток и выключателей
code_block_53 = CodeBlock(w=join) { w; }
code_block_54 = CodeBlock { "БУДОВА_Уровень оборудования"; }
code_block_55 = CodeBlock { "Уровень"; }
getParameterValueByName_12 = Element.GetParameterValueByName(element=code_block_53, parameterName=code_block_55)
code_block_56 = CodeBlock(a=getParameterValueByName_12) { a.Name; }
code_block_57 = CodeBlock { 1; 2; }
substring = String.Substring(str=code_block_56, startIndex=code_block_57.out0, length=code_block_57.out1)
setParameterByName_6 = Element.SetParameterByName(element=code_block_53, parameterName=code_block_54, value=substring)
getParameterValueByName_13 = Element.GetParameterValueByName(element=setParameterByName_6, parameterName=code_block_54)
code_block_58 = CodeBlock { "БУДОВА_Этаж"; }
setParameterByName_7 = Element.SetParameterByName(element=code_block_53, parameterName=code_block_58, value=code_block_56)

# group: Светильники категория Осветительные приборы
категория_осветительные_приборы = CodeBlock { Category.ByName("OST_LightingFixtures"); }
all_elements_of_category_4 = ElementsOfCategory(Category=категория_осветительные_приборы)

# group: Отобрали светильники, у которых есть уровень
code_block_59 = CodeBlock(w=all_elements_of_category_4) { w; }
code_block_60 = CodeBlock { "Уровень"; }
getParameterValueByName_14 = Element.GetParameterValueByName(element=code_block_59, parameterName=code_block_60)
code_block_61 = CodeBlock(a=getParameterValueByName_14) { a==""?false:true; }
filterByBoolMask_7 = List.FilterByBoolMask(list=code_block_59, mask=code_block_61)

code_block_62 = CodeBlock(w=filterByBoolMask_7.in) { w; }

# group: Из "Имя панели" записали в "БУДОВА_Группа"для светильников
code_block_63 = CodeBlock { "БУДОВА_Группа"; }
code_block_64 = CodeBlock { "Панель"; }
element_getparametervaluebyname = Element.GetParameterValueByName(element=code_block_62, parameterName=code_block_64)  # "Element.GetParameterValueByName если ни к чему не подключен, то нет "Панель""
если_в_строке_пустота_строка_не_2 = CodeBlock(a=element_getparametervaluebyname) { a==""?"X":a; }  # "если в строке пустота (строка не может иметь нулевую длину)"
code_block_65 = CodeBlock { "."; }
lastIndexOf_2 = String.LastIndexOf(str=element_getparametervaluebyname, searchFor=code_block_65)
точку_не_удаляем_2 = CodeBlock(b=lastIndexOf_2) { b; }
length_2 = String.Length(str=element_getparametervaluebyname)
сколько_разрядов_вместе_с_точкой_2 = CodeBlock(a=length_2, b=точку_не_удаляем_2) { a-b; }
remove_3 = String.Remove(string=если_в_строке_пустота_строка_не_2, startIndex=точку_не_удаляем_2, count=сколько_разрядов_вместе_с_точкой_2)
setParameterByName_8 = Element.SetParameterByName(element=code_block_62, parameterName=code_block_63, value=remove_3)
getParameterValueByName_15 = Element.GetParameterValueByName(element=setParameterByName_8, parameterName=code_block_63)

# group: Переименование префикса цепи в панелях в соответсвии с именем панели (панели содержание "М" в "Имя панели"). Здесь же добавляется точка и номер этажа
code_block_66 = CodeBlock(w=filterByBoolMask_6.in) { w; }
code_block_67 = CodeBlock { "Префикс цепи"; }
getParameterValueByName_16 = Element.GetParameterValueByName(element=code_block_66, parameterName=code_block_67)
если_в_строке_пустота_строка_не_3 = CodeBlock(a=getParameterValueByName_16) { a==""?"X":a; }  # "если в строке пустота (строка не может иметь нулевую длину)"
code_block_68 = CodeBlock { "Имя панели"; }
getParameterValueByName_17 = Element.GetParameterValueByName(element=code_block_66, parameterName=code_block_68)
code_block_69 = CodeBlock { 0; }
code_block_70 = CodeBlock { "-"; }
lastIndexOf_3 = String.LastIndexOf(str=getParameterValueByName_17, searchFor=code_block_70)
code_block_71 = CodeBlock(b=lastIndexOf_3) { b+1; }
remove_4 = String.Remove(string=getParameterValueByName_17, startIndex=code_block_69, count=code_block_71)
code_block_72 = CodeBlock { "/"; }
lastIndexOf_4 = String.LastIndexOf(str=remove_4, searchFor=code_block_72)
length_3 = String.Length(str=remove_4)
code_block_73 = CodeBlock(a=length_3, b=lastIndexOf_4) { a-b; }
remove_5 = String.Remove(string=remove_4, startIndex=lastIndexOf_4, count=code_block_73)
code_block_74 = CodeBlock(a=getParameterValueByName_17, b=remove_5) { a+"."+b+"эт_цепь"; }
replace_2 = String.Replace(string=если_в_строке_пустота_строка_не_3, searchFor=если_в_строке_пустота_строка_не_3, replaceWith=code_block_74)
setParameterByName_9 = Element.SetParameterByName(element=code_block_66, parameterName=code_block_67, value=replace_2)

# group: Список неподключенных светильников
code_block_75 = CodeBlock(a=element_getparametervaluebyname) { a==""; }
filterByBoolMask_8 = List.FilterByBoolMask(list=code_block_62, mask=code_block_75)
code_block_76 = CodeBlock(a=filterByBoolMask_8.in) { a.Id; }
code_block_77 = CodeBlock { "Уровень"; }
getParameterValueByName_18 = Element.GetParameterValueByName(element=filterByBoolMask_8.in, parameterName=code_block_77)
уровень = CodeBlock(a=getParameterValueByName_18) { a.Name; }

# group: Список неподключенных ЯТП, розеток и выключателей
code_block_78 = CodeBlock(a=getParameterValueByName_2) { a==""; }
filterByBoolMask_9 = List.FilterByBoolMask(list=code_block_7, mask=code_block_78)
code_block_79 = CodeBlock { "Уровень"; }
getParameterValueByName_19 = Element.GetParameterValueByName(element=filterByBoolMask_9.in, parameterName=code_block_79)
уровень_27 = CodeBlock(a=getParameterValueByName_19) { a.Name; }
code_block_80 = CodeBlock(a=filterByBoolMask_9.in) { a.Id; }

# group: Отобрали только коробки ввода в квартиру
панели_элементы = CodeBlock(w=filterByBoolMask_6.in) { w; }
elementType = Element.ElementType(element=панели_элементы)
code_block_81 = CodeBlock(a=elementType) { a.Name; }
code_block_82 = CodeBlock(a=code_block_81) { a=="BDV_E000_Коробка ввода в квартиру"; }
filterByBoolMask_10 = List.FilterByBoolMask(list=панели_элементы, mask=code_block_82)

# group: Категория Электрические цепи
категория_электрические_цепи = CodeBlock { Category.ByName("OST_ElectricalCircuit"); }
all_elements_of_category_5 = ElementsOfCategory(Category=категория_электрические_цепи)

code_block_83 = CodeBlock(w=all_elements_of_category_5) { w; }

# group: Отобрали цепи, которыми подключены коробки ввода в квартиру (М)
code_block_84 = CodeBlock { "Номер цепи"; }
getParameterValueByName_20 = Element.GetParameterValueByName(element=code_block_83, parameterName=code_block_84)
code_block_85 = CodeBlock { "М"; }
contains_3 = String.Contains(str=getParameterValueByName_20, searchFor=code_block_85)
filterByBoolMask_11 = List.FilterByBoolMask(list=code_block_83, mask=contains_3)

# group: ПОЛУЧИЛИ ДЛИНЫ ЦЕПЕЙ, увеличив на 5% и ПРИСОВИЛИ им соответствующие СЕЧЕНИЯ КАБЕЛЕЙ (тип данных строка) (меньше 25м=10мм больше либо равно 25м=16мм все что не меньше 40м=25мм)
code_block_86 = CodeBlock { "Длина"; }
getParameterValueByName_21 = Element.GetParameterValueByName(element=filterByBoolMask_11.in, parameterName=code_block_86)
code_block_87 = CodeBlock(a=getParameterValueByName_21) { (a*1.05)/1000; }
code_block_88 = CodeBlock { 0; }
round = Math.Round(number=code_block_87, digits=code_block_88)
code_block_89 = CodeBlock(a=round) { a<25?"ВВГнг-LS 3х10":a>=25 && a<40?"ВВГнг-LS 3х16":"ВВГнг-LS 3х25"; }
code_block_90 = CodeBlock { "ВВГнг-LS 3х16"; }
allIndicesOf = List.AllIndicesOf(list=code_block_89, item=code_block_90)
getItemAtIndex = List.GetItemAtIndex(list=filterByBoolMask_11.in, index=allIndicesOf)
code_block_91 = CodeBlock { "ВВГнг-LS 3х10"; }
allIndicesOf_2 = List.AllIndicesOf(list=code_block_89, item=code_block_91)
getItemAtIndex_2 = List.GetItemAtIndex(list=filterByBoolMask_11.in, index=allIndicesOf_2)
code_block_92 = CodeBlock { "ВВГнг-LS 3х25"; }
allIndicesOf_3 = List.AllIndicesOf(list=code_block_89, item=code_block_92)
getItemAtIndex_3 = List.GetItemAtIndex(list=filterByBoolMask_11.in, index=allIndicesOf_3)

# group: Если типы кабелей присвоены, то они не будут изменены. Значения типов кабелей присваивается только параметрам у которых значение равно (нет). Типы кабелей цепям.
code_block_93 = CodeBlock { "Тип кабеля"; }
getParameterValueByName_22 = Element.GetParameterValueByName(element=getItemAtIndex, parameterName=code_block_93)
убираем_где_нет_элеменов_а_то_не = CodeBlock(a=getParameterValueByName_22) { a=="(нет)"; }  # "убираем где нет элеменов, а то не сработает скрипт"
filterByBoolMask_12 = List.FilterByBoolMask(list=getItemAtIndex, mask=убираем_где_нет_элеменов_а_то_не)

code_block_94 = CodeBlock { "Тип кабеля"; }

# group: Выбрали из проекта ОБРАЗЦЫ ДЛЯ ПРИСВОЕНИЯ ТИПОВ КАБЕЛЕЙ ТОЛЬКО ДЛЯ КОРОБОК ВВОДА В КВАРТИРУ (правила длины) Для этого в проекте нужно было заранее присвоить на этаже разные типы кабелей, придерживаясь правила (меньше 25м=10мм больше либо равно 25м=16мм все что не меньше 40м=25мм). Присвоенные в проекте типы кабелей скриптом не меняются
code_block_95 = CodeBlock { "Тип кабеля"; }
getParameterValueByName_23 = Element.GetParameterValueByName(element=filterByBoolMask_11.in, parameterName=code_block_95)
убираем_где_нет_элеменов_а_то_не_2 = CodeBlock(a=getParameterValueByName_23) { a=="(нет)"; }  # "убираем где нет элеменов, а то не сработает скрипт"
filterByBoolMask_13 = List.FilterByBoolMask(list=getParameterValueByName_23, mask=убираем_где_нет_элеменов_а_то_не_2)
code_block_96 = CodeBlock(a=filterByBoolMask_13.out) { a.Name; }
code_block_97 = CodeBlock { "ВВГнг-LS 3х16"; }
allIndicesOf_4 = List.AllIndicesOf(list=code_block_96, item=code_block_97)
просто_первый_попавшийся = CodeBlock(a=allIndicesOf_4) { a[0]; }
getItemAtIndex_4 = List.GetItemAtIndex(list=filterByBoolMask_13.out, index=просто_первый_попавшийся)
code_block_98 = CodeBlock { "ВВГнг-LS 3х10"; }
allIndicesOf_5 = List.AllIndicesOf(list=code_block_96, item=code_block_98)
просто_первый_попавшийся_2 = CodeBlock(a=allIndicesOf_5) { a[0]; }
getItemAtIndex_5 = List.GetItemAtIndex(list=filterByBoolMask_13.out, index=просто_первый_попавшийся_2)
code_block_99 = CodeBlock { "ВВГнг-LS 3х25"; }
allIndicesOf_6 = List.AllIndicesOf(list=code_block_96, item=code_block_99)
просто_первый_попавшийся_3 = CodeBlock(a=allIndicesOf_6) { a[0]; }
getItemAtIndex_6 = List.GetItemAtIndex(list=filterByBoolMask_13.out, index=просто_первый_попавшийся_3)

ввгнг_ls_3х16_element = Element.SetParameterByName(element=filterByBoolMask_12.in, parameterName=code_block_94, value=getItemAtIndex_4)

# group: Если типы кабелей присвоены, то они не будут изменены. Значения типов кабелей присваивается только параметрам у которых значение равно (нет). Типы кабелей цепям.
code_block_100 = CodeBlock { "Тип кабеля"; }
getParameterValueByName_24 = Element.GetParameterValueByName(element=getItemAtIndex_2, parameterName=code_block_100)
убираем_где_нет_элеменов_а_то_не_3 = CodeBlock(a=getParameterValueByName_24) { a=="(нет)"; }  # "убираем где нет элеменов, а то не сработает скрипт"
filterByBoolMask_14 = List.FilterByBoolMask(list=getItemAtIndex_2, mask=убираем_где_нет_элеменов_а_то_не_3)

code_block_101 = CodeBlock { "Тип кабеля"; }
ввгнг_ls_3х10_element = Element.SetParameterByName(element=filterByBoolMask_14.in, parameterName=code_block_101, value=getItemAtIndex_5)

# group: Если типы кабелей присвоены, то они не будут изменены. Значения типов кабелей присваивается только параметрам у которых значение равно (нет). Типы кабелей цепям.
code_block_102 = CodeBlock { "Тип кабеля"; }
getParameterValueByName_25 = Element.GetParameterValueByName(element=getItemAtIndex_3, parameterName=code_block_102)
убираем_где_нет_элеменов_а_то_не_4 = CodeBlock(a=getParameterValueByName_25) { a=="(нет)"; }  # "убираем где нет элеменов, а то не сработает скрипт"
filterByBoolMask_15 = List.FilterByBoolMask(list=getItemAtIndex_3, mask=убираем_где_нет_элеменов_а_то_не_4)

code_block_103 = CodeBlock { "Тип кабеля"; }
ввгнг_ls_3х25_element = Element.SetParameterByName(element=filterByBoolMask_15.in, parameterName=code_block_103, value=getItemAtIndex_6)

# group: Получили электрические цепи в той последовательности, в которой идут коробки ввода в квартиру с помощью словаря
code_block_104 = CodeBlock { "Имя панели"; }
getParameterValueByName_26 = Element.GetParameterValueByName(element=filterByBoolMask_10.in, parameterName=code_block_104)
join_3 = List.Join(list0=ввгнг_ls_3х16_element, list1=filterByBoolMask_12.out, list2=ввгнг_ls_3х10_element, list3=filterByBoolMask_14.out, list4=ввгнг_ls_3х25_element, list5=filterByBoolMask_15.out)
code_block_105 = CodeBlock { "Панель"; }
getParameterValueByName_27 = Element.GetParameterValueByName(element=join_3, parameterName=code_block_105)
эл_цепи_в_которых_панель = CodeBlock(w=join_3) { w; }  # "Эл.цепи в которых Панель содержит "М""
byKeysValues = DesignScript.Builtin.Dictionary.ByKeysValues(keys=getParameterValueByName_27, values=эл_цепи_в_которых_панель)
valueAtKey = DesignScript.Builtin.Dictionary.ValueAtKey(dictionary=byKeysValues, key=getParameterValueByName_26)

# group: Создали строки для записей в соответствующую коробку ввода в квартиру
code_block_106 = CodeBlock { "Тип кабеля"; }
getParameterValueByName_28 = Element.GetParameterValueByName(element=valueAtKey, parameterName=code_block_106)
code_block_107 = CodeBlock(a=getParameterValueByName_28) { a.Name; }
code_block_108 = CodeBlock { "Длина"; }
getParameterValueByName_29 = Element.GetParameterValueByName(element=valueAtKey, parameterName=code_block_108)
code_block_109 = CodeBlock(a=getParameterValueByName_29) { (a*1.05)/1000; }
code_block_110 = CodeBlock { 0; }
round_2 = Math.Round(number=code_block_109, digits=code_block_110)
string_from_object = FromObject(obj=round_2)
code_block_111 = CodeBlock { -7; 7; }
remove_6 = String.Remove(string=string_from_object, startIndex=code_block_111.out0, count=code_block_111.out1)
code_block_112 = CodeBlock(a=getParameterValueByName_26, b=code_block_107, c=remove_6) { a+" - "+b+" L="+c+"м"; }

# group: Коробка ввода в квартиру
code_block_113 = CodeBlock { "БУДОВА_Тип кабеля"; }
setParameterByName_10 = Element.SetParameterByName(element=filterByBoolMask_10.in, parameterName=code_block_113, value=code_block_112)

code_block_114 = CodeBlock { "х16"; }
contains_4 = String.Contains(str=code_block_112, searchFor=code_block_114)
filterByBoolMask_16 = List.FilterByBoolMask(list=setParameterByName_10, mask=contains_4)
code_block_115 = CodeBlock(w16=filterByBoolMask_16.in) { w16; }
code_block_116 = CodeBlock { "БУДОВА_Red"; }
code_block_117 = CodeBlock { true; }
setParameterByName_11 = Element.SetParameterByName(element=code_block_115, parameterName=code_block_116, value=code_block_117)
code_block_118 = CodeBlock { "х25"; }
contains_5 = String.Contains(str=code_block_112, searchFor=code_block_118)
filterByBoolMask_17 = List.FilterByBoolMask(list=setParameterByName_10, mask=contains_5)
code_block_119 = CodeBlock(w25=filterByBoolMask_17.in) { w25; }
code_block_120 = CodeBlock { "БУДОВА_Red"; }
code_block_121 = CodeBlock { false; }
setParameterByName_12 = Element.SetParameterByName(element=code_block_119, parameterName=code_block_120, value=code_block_121)
code_block_122 = CodeBlock { "БУДОВА_Black"; }
code_block_123 = CodeBlock { false; }
setParameterByName_13 = Element.SetParameterByName(element=code_block_115, parameterName=code_block_122, value=code_block_123)
code_block_124 = CodeBlock { "БУДОВА_Black"; }
code_block_125 = CodeBlock { false; }
setParameterByName_14 = Element.SetParameterByName(element=code_block_119, parameterName=code_block_124, value=code_block_125)

# group: если цепь содержит "КК"
code_block_126 = CodeBlock { "Номер цепи"; }
getParameterValueByName_30 = Element.GetParameterValueByName(element=all_elements_of_category_5, parameterName=code_block_126)
code_block_127 = CodeBlock { "КК"; }
contains_6 = String.Contains(str=getParameterValueByName_30, searchFor=code_block_127)
filterByBoolMask_18 = List.FilterByBoolMask(list=code_block_83, mask=contains_6)

# group: если цепь содержит "гр." то параметр "БУДОВА_Group" вкл, если не содержит то выкл Для спецификации, чтоб ввести разные коэф. на группы (1,1) и на квартиры со всеми другими линиями/стояками (1,05)
code_block_128 = CodeBlock { "гр."; }
contains_7 = String.Contains(str=getParameterValueByName_30, searchFor=code_block_128)
filterByBoolMask_19 = List.FilterByBoolMask(list=code_block_83, mask=contains_7)
code_block_129 = CodeBlock { "БУДОВА_Group"; }
code_block_130 = CodeBlock { false; }
setParameterByName_15 = Element.SetParameterByName(element=filterByBoolMask_19.out, parameterName=code_block_129, value=code_block_130)
code_block_131 = CodeBlock { "БУДОВА_Group"; }
code_block_132 = CodeBlock { true; }
setParameterByName_16 = Element.SetParameterByName(element=filterByBoolMask_19.in, parameterName=code_block_131, value=code_block_132)

code_block_133 = CodeBlock { "БУДОВА_Green"; }
code_block_134 = CodeBlock { false; }
setParameterByName_17 = Element.SetParameterByName(element=code_block_115, parameterName=code_block_133, value=code_block_134)
code_block_135 = CodeBlock { "БУДОВА_Green"; }
code_block_136 = CodeBlock { true; }
setParameterByName_18 = Element.SetParameterByName(element=code_block_119, parameterName=code_block_135, value=code_block_136)
code_block_137 = CodeBlock { "х10"; }
contains_8 = String.Contains(str=code_block_112, searchFor=code_block_137)
filterByBoolMask_20 = List.FilterByBoolMask(list=setParameterByName_10, mask=contains_8)
code_block_138 = CodeBlock(w10=filterByBoolMask_20.in) { w10; }
code_block_139 = CodeBlock { "БУДОВА_Green"; }
code_block_140 = CodeBlock { false; }
setParameterByName_19 = Element.SetParameterByName(element=code_block_138, parameterName=code_block_139, value=code_block_140)
code_block_141 = CodeBlock { "БУДОВА_Black"; }
code_block_142 = CodeBlock { true; }
setParameterByName_20 = Element.SetParameterByName(element=code_block_138, parameterName=code_block_141, value=code_block_142)
code_block_143 = CodeBlock { "БУДОВА_Red"; }
code_block_144 = CodeBlock { false; }
setParameterByName_21 = Element.SetParameterByName(element=code_block_138, parameterName=code_block_143, value=code_block_144)

# group: Получили коннекторы
code_block_145 = CodeBlock(a=all_elements_of_category_5) { a[0]; }  # frozen
python_script_2 = Python(IN[0]=code_block_145)  # IronPython2
# ---------- python_script_2.python (20 lines) ----------
# Загрузить стандартную библиотеку Python и библиотеку DesignScript
import sys
import clr
clr.AddReference('RevitAPI')
import Autodesk
from Autodesk.Revit.DB import *
 
#На вход подаю один фемели-инстанс с коннекторами.
elem = UnwrapElement(IN[0])
#slist = [SelectPanel(x) for x in elem]
 
#OUT = DB.SelectPanel(elem)
#OUT = elem.PanelName

#OUT = elem.ConnectorManager.Connectors

con_owner = []
for c in elem.ConnectorManager.Connectors:
	con_owner.append(c.Owner)
OUT = con_owner
# ----------------------------------------

parameters = Element.Parameters(element=setParameterByName_10)

# group: Можно поставить этот нод и будет все срабатывать, но когда выделяет желтым, то видно и не забудешь посмотреть, что что-то может быть неподключенным
если_в_строке_пустота_строка_не_4 = CodeBlock { a==""?"X":a; }  # "если в строке пустота (строка не может иметь нулевую длину)"; unwired: a

# group: Для всех цепей кроме КК
code_block_146 = CodeBlock(w=filterByBoolMask_18.out) { w; }
code_block_147 = CodeBlock { "БУДОВА_Уровень оборудования"; }
getParameterValueByName_31 = Element.GetParameterValueByName(element=filterByBoolMask_18.out, parameterName=code_block_147)
если_в_строке_пустота_строка_не_5 = CodeBlock(a=getParameterValueByName_31) { a==""?"X":a; }  # "если в строке пустота (строка не может иметь нулевую длину)"
code_block_148 = CodeBlock { "Номер цепи"; }
getParameterValueByName_32 = Element.GetParameterValueByName(element=code_block_146, parameterName=code_block_148)
code_block_149 = CodeBlock { "э"; }
boolean = BoolSelector(false)
# note: Обязательно "э" с учетом регистра, тогда Э в ЩЭ не будет учитываться и все будет работать
indexOf_2 = String.IndexOf(str=getParameterValueByName_32, searchFor=code_block_149, ignoreCase=boolean)
length_4 = String.Length(str=getParameterValueByName_32)
code_block_150 = CodeBlock(L=length_4, i=indexOf_2) { L-i; }
remove_7 = String.Remove(string=getParameterValueByName_32, startIndex=indexOf_2, count=code_block_150)
code_block_151 = CodeBlock { 0; }
code_block_152 = CodeBlock { "."; }
lastIndexOf_5 = String.LastIndexOf(str=remove_7, searchFor=code_block_152)
code_block_153 = CodeBlock(b=lastIndexOf_5) { b+1; }
remove_8 = String.Remove(string=remove_7, startIndex=code_block_151, count=code_block_153)
replace_3 = String.Replace(string=если_в_строке_пустота_строка_не_5, searchFor=если_в_строке_пустота_строка_не_5, replaceWith=remove_8)
setParameterByName_22 = Element.SetParameterByName(element=code_block_146, parameterName=code_block_147, value=replace_3)
code_block_154 = CodeBlock { "БУДОВА_Группа"; }
setParameterByName_23 = Element.SetParameterByName(element=setParameterByName_22, parameterName=code_block_154, value=remove_7)
getParameterValueByName_33 = Element.GetParameterValueByName(element=setParameterByName_23, parameterName=code_block_154)
code_block_155 = CodeBlock { "Имя нагрузки"; }
code_block_156 = CodeBlock { "Панель"; }
getParameterValueByName_34 = Element.GetParameterValueByName(element=code_block_146, parameterName=code_block_156)
setParameterByName_24 = Element.SetParameterByName(element=code_block_146, parameterName=code_block_155, value=getParameterValueByName_34)
code_block_157 = CodeBlock { "БУДОВА_Группа"; }
getParameterValueByName_35 = Element.GetParameterValueByName(element=setParameterByName_24, parameterName=code_block_155)
setParameterByName_25 = Element.SetParameterByName(element=setParameterByName_24, parameterName=code_block_157, value=getParameterValueByName_35)
code_block_158 = CodeBlock { "БУДОВА_Уровень оборудования"; }
setParameterByName_26 = Element.SetParameterByName(element=setParameterByName_25, parameterName=code_block_158, value=remove_8)
getParameterValueByName_36 = Element.GetParameterValueByName(element=setParameterByName_26, parameterName=code_block_158)
getParameterValueByName_37 = Element.GetParameterValueByName(element=setParameterByName_25, parameterName=code_block_157)

# group: Отобрали цепи, которыми подключены коробки в ванную (КК)
code_block_159 = CodeBlock { "Номер цепи"; }
getParameterValueByName_38 = Element.GetParameterValueByName(element=code_block_83, parameterName=code_block_159)
code_block_160 = CodeBlock { "КК"; }
contains_9 = String.Contains(str=getParameterValueByName_38, searchFor=code_block_160)
filterByBoolMask_21 = List.FilterByBoolMask(list=code_block_83, mask=contains_9)

# group: Если типы кабелей присвоены, то они не будут изменены. Значения типов кабелей присваивается только параметрам у которых значение равно (нет). Типы кабелей цепям.
code_block_161 = CodeBlock { "Тип кабеля"; }
getParameterValueByName_39 = Element.GetParameterValueByName(element=filterByBoolMask_21.in, parameterName=code_block_161)
убираем_где_нет_элеменов_а_то_не_5 = CodeBlock(a=getParameterValueByName_39) { a=="(нет)"; }  # "убираем где нет элеменов, а то не сработает скрипт"
filterByBoolMask_22 = List.FilterByBoolMask(list=filterByBoolMask_21.in, mask=убираем_где_нет_элеменов_а_то_не_5)

code_block_162 = CodeBlock { "Тип кабеля"; }

# group: Выбрали из проекта ОБРАЗЦЫ ДЛЯ ПРИСВОЕНИЯ ТИПОВ КАБЕЛЕЙ ДЛЯ КОРОБОК В ВАННУЮ Для этого в проекте нужно было заранее присвоить одной и цепей тип кабеля Присвоенные в проекте типы кабелей скриптом не меняются
code_block_163 = CodeBlock { "Тип кабеля"; }
getParameterValueByName_40 = Element.GetParameterValueByName(element=filterByBoolMask_21.in, parameterName=code_block_163)
убираем_где_нет_элеменов_а_то_не_6 = CodeBlock(a=getParameterValueByName_40) { a=="(нет)"; }  # "убираем где нет элеменов, а то не сработает скрипт"
filterByBoolMask_23 = List.FilterByBoolMask(list=getParameterValueByName_40, mask=убираем_где_нет_элеменов_а_то_не_6)
code_block_164 = CodeBlock(a=filterByBoolMask_23.out) { a.Name; }
code_block_165 = CodeBlock { "ПВ1 1х4"; }
allIndicesOf_7 = List.AllIndicesOf(list=code_block_164, item=code_block_165)
просто_первый_попавшийся_4 = CodeBlock(a=allIndicesOf_7) { a[0]; }
getItemAtIndex_7 = List.GetItemAtIndex(list=filterByBoolMask_23.out, index=просто_первый_попавшийся_4)

ввгнг_ls_3х16_element_2 = Element.SetParameterByName(element=filterByBoolMask_22.in, parameterName=code_block_162, value=getItemAtIndex_7)

# group: Для цепей КК
code_block_166 = CodeBlock(w=filterByBoolMask_18.in) { w; }
code_block_167 = CodeBlock { "Имя нагрузки"; }
code_block_168 = CodeBlock { "Имя нагрузки"; }
getParameterValueByName_41 = Element.GetParameterValueByName(element=code_block_166, parameterName=code_block_168)
code_block_169 = CodeBlock { "."; }
boolean_2 = BoolSelector(true)
indexOf_3 = String.IndexOf(str=getParameterValueByName_41, searchFor=code_block_169, ignoreCase=boolean_2)
code_block_170 = CodeBlock(i=indexOf_3) { i+1; }
length_5 = String.Length(str=getParameterValueByName_41)
code_block_171 = CodeBlock(i=length_5, L=code_block_170) { i-L; }
remove_9 = String.Remove(string=getParameterValueByName_41, startIndex=code_block_170, count=code_block_171)
code_block_172 = CodeBlock { "Панель"; }
getParameterValueByName_42 = Element.GetParameterValueByName(element=code_block_166, parameterName=code_block_172)
code_block_173 = CodeBlock { "-"; }
boolean_3 = BoolSelector(true)
indexOf_4 = String.IndexOf(str=getParameterValueByName_42, searchFor=code_block_173, ignoreCase=boolean_3)
code_block_174 = CodeBlock(i=indexOf_4) { i+1; }
code_block_175 = CodeBlock { "/"; }
boolean_4 = BoolSelector(true)
indexOf_5 = String.IndexOf(str=getParameterValueByName_42, searchFor=code_block_175, ignoreCase=boolean_4)
code_block_176 = CodeBlock(i=indexOf_5, L=code_block_174) { i-L; }
substring_2 = String.Substring(str=getParameterValueByName_42, startIndex=code_block_174, length=code_block_176)
insert_28 = String.Insert(string=remove_9, index=code_block_170, toInsert=substring_2)
setParameterByName_27 = Element.SetParameterByName(element=code_block_166, parameterName=code_block_167, value=insert_28)
code_block_177 = CodeBlock { "БУДОВА_Группа"; }
getParameterValueByName_43 = Element.GetParameterValueByName(element=setParameterByName_27, parameterName=code_block_167)
setParameterByName_28 = Element.SetParameterByName(element=setParameterByName_27, parameterName=code_block_177, value=getParameterValueByName_43)
getParameterValueByName_44 = Element.GetParameterValueByName(element=setParameterByName_28, parameterName=code_block_177)
code_block_178 = CodeBlock { "БУДОВА_Уровень оборудования"; }
setParameterByName_29 = Element.SetParameterByName(element=setParameterByName_28, parameterName=code_block_178, value=substring_2)
getParameterValueByName_45 = Element.GetParameterValueByName(element=setParameterByName_29, parameterName=code_block_178)
code_block_179 = CodeBlock { "БУДОВА_Этаж"; }

# group: Отобрали панели, которые в параметре типа "БУДОВА_Обозначение" содержат "КК"
elementType_2 = Element.ElementType(element=code_block_24)
code_block_180 = CodeBlock { "БУДОВА_Обозначение"; }
getParameterValueByName_46 = Element.GetParameterValueByName(element=elementType_2, parameterName=code_block_180)
code_block_181 = CodeBlock { "КК"; }
contains_10 = String.Contains(str=getParameterValueByName_46, searchFor=code_block_181)
filterByBoolMask_24 = List.FilterByBoolMask(list=code_block_24, mask=contains_10)

# group: Создание с чистого листа имен панелей КК в соответсвии с уровнем (этажом) (даже если в именах панелей КК что-то есть - перепишется) "БУДОВА_Уровень оборудования", "БУДОВА_Этаж", "БУДОВА_Группа"
code_block_182 = CodeBlock { "Имя панели"; }
code_block_183 = CodeBlock { "Имя панели"; }
getParameterValueByName_47 = Element.GetParameterValueByName(element=filterByBoolMask_24.in, parameterName=code_block_183)
code_block_184 = CodeBlock { "."; }
lastIndexOf_6 = String.LastIndexOf(str=getParameterValueByName_47, searchFor=code_block_184)
точку_не_удаляем_3 = CodeBlock(b=lastIndexOf_6) { b+1; }
length_6 = String.Length(str=getParameterValueByName_47)
сколько_разрядов_после_точки = CodeBlock(a=length_6, b=точку_не_удаляем_3) { a-b; }
remove_10 = String.Remove(string=getParameterValueByName_47, startIndex=точку_не_удаляем_3, count=сколько_разрядов_после_точки)
length_7 = String.Length(str=remove_10)
code_block_185 = CodeBlock { "Уровень"; }
getParameterValueByName_48 = Element.GetParameterValueByName(element=filterByBoolMask_24.in, parameterName=code_block_185)
code_block_186 = CodeBlock(a=getParameterValueByName_48) { a.Name; }
code_block_187 = CodeBlock { 1; 2; }
substring_3 = String.Substring(str=code_block_186, startIndex=code_block_187.out0, length=code_block_187.out1)
insert_29 = String.Insert(string=remove_10, index=length_7, toInsert=substring_3)
setParameterByName_30 = Element.SetParameterByName(element=filterByBoolMask_24.in, parameterName=code_block_182, value=insert_29)
getParameterValueByName_49 = Element.GetParameterValueByName(element=setParameterByName_30, parameterName=code_block_182)
code_block_188 = CodeBlock { "БУДОВА_Группа"; }
setParameterByName_31 = Element.SetParameterByName(element=setParameterByName_30, parameterName=code_block_188, value=insert_29)
getParameterValueByName_50 = Element.GetParameterValueByName(element=setParameterByName_31, parameterName=code_block_188)
code_block_189 = CodeBlock { "БУДОВА_Этаж"; }
setParameterByName_32 = Element.SetParameterByName(element=setParameterByName_31, parameterName=code_block_189, value=code_block_186)
code_block_190 = CodeBlock { "БУДОВА_Уровень оборудования"; }
setParameterByName_33 = Element.SetParameterByName(element=setParameterByName_31, parameterName=code_block_190, value=substring_3)

# group: Для цепей КК
code_block_191 = CodeBlock(w=filterByBoolMask_18.in) { w; }
code_block_192 = CodeBlock { "Имя нагрузки"; }
code_block_193 = CodeBlock { "Панель"; }
getParameterValueByName_51 = Element.GetParameterValueByName(element=code_block_191, parameterName=code_block_193)
code_block_194 = CodeBlock(і=getParameterValueByName_51) { і; }
code_block_195 = CodeBlock { "/"; }
boolean_5 = BoolSelector(true)
indexOf_6 = String.IndexOf(str=code_block_194, searchFor=code_block_195, ignoreCase=boolean_5)
code_block_196 = CodeBlock(i=indexOf_6) { i+1; }
length_8 = String.Length(str=code_block_194)
code_block_197 = CodeBlock(i=length_8, L=code_block_196) { i-L; }
string_substring_номер_коробки = String.Substring(str=code_block_194, startIndex=code_block_196, length=code_block_197)
code_block_198 = CodeBlock { "-"; }
boolean_6 = BoolSelector(true)
indexOf_7 = String.IndexOf(str=code_block_194, searchFor=code_block_198, ignoreCase=boolean_6)
code_block_199 = CodeBlock(i=indexOf_7) { i+1; }
code_block_200 = CodeBlock(i=indexOf_6, L=code_block_199) { i-L; }
string_substring_номер_этажа = String.Substring(str=code_block_194, startIndex=code_block_199, length=code_block_200)
code_block_201 = CodeBlock(а=string_substring_номер_коробки, в=string_substring_номер_этажа) { "КК" + а + "." + в; }
setParameterByName_34 = Element.SetParameterByName(element=code_block_191, parameterName=code_block_192, value=code_block_201)
getParameterValueByName_52 = Element.GetParameterValueByName(element=setParameterByName_34, parameterName=code_block_192)

# group: У панели не выствлен параметр "Обозначение цепей" - с префиксом Здесь получили имя панели, которой нужно выставить параметр "Обозначение цепей" - с префиксом Имя цепи тогда получается 1 или другой может быть номер
code_block_202 = CodeBlock { "Панель"; }
getParameterValueByName_53 = Element.GetParameterValueByName(element=code_block_146, parameterName=code_block_202)
code_block_203 = CodeBlock { -1; }
indexOf_8 = List.IndexOf(list=indexOf_2, element=code_block_203)
code_block_204 = CodeBlock(a=indexOf_8) { a== -1?0:a; }
getItemAtIndex_8 = List.GetItemAtIndex(list=getParameterValueByName_53, index=code_block_204)

# group: Переименование имен панелей групп в соответсвии с уровнем (этажом). "БУДОВА_Уровень оборудования", "БУДОВА_Этаж"
code_block_205 = CodeBlock { "Имя панели"; }
getParameterValueByName_54 = Element.GetParameterValueByName(element=filterByBoolMask_4.in, parameterName=code_block_205)
code_block_206 = CodeBlock { "."; }
lastIndexOf_7 = String.LastIndexOf(str=getParameterValueByName_54, searchFor=code_block_206)
точку_не_удаляем_4 = CodeBlock(b=lastIndexOf_7) { b+1; }
length_9 = String.Length(str=getParameterValueByName_54)
сколько_разрядов_после_точки_2 = CodeBlock(a=length_9, b=точку_не_удаляем_4) { a-b; }  # "Сколько разрядов после точки (Lстроки - индекс точки)"
remove_11 = String.Remove(string=getParameterValueByName_54, startIndex=точку_не_удаляем_4, count=сколько_разрядов_после_точки_2)
length_10 = String.Length(str=remove_11)
code_block_207 = CodeBlock { "Уровень"; }
getParameterValueByName_55 = Element.GetParameterValueByName(element=filterByBoolMask_4.in, parameterName=code_block_207)
code_block_208 = CodeBlock(a=getParameterValueByName_55) { a.Name; }
code_block_209 = CodeBlock { 1; 2; }
substring_4 = String.Substring(str=code_block_208, startIndex=code_block_209.out0, length=code_block_209.out1)
insert_30 = String.Insert(string=remove_11, index=length_10, toInsert=substring_4)
setParameterByName_35 = Element.SetParameterByName(element=filterByBoolMask_4.in, parameterName=code_block_205, value=insert_30)
code_block_210 = CodeBlock { "БУДОВА_Группа"; }
setParameterByName_36 = Element.SetParameterByName(element=setParameterByName_35, parameterName=code_block_210, value=insert_30)
code_block_211 = CodeBlock { "БУДОВА_Этаж"; }
setParameterByName_37 = Element.SetParameterByName(element=setParameterByName_36, parameterName=code_block_211, value=code_block_208)
code_block_212 = CodeBlock { "БУДОВА_Уровень оборудования"; }
setParameterByName_38 = Element.SetParameterByName(element=setParameterByName_36, parameterName=code_block_212, value=substring_4)

# group: Из уровней заполнили "БУДОВА_Уровень оборудования", "БУДОВА_Этаж" (все экземпляры категории Осветительные приборы)
code_block_213 = CodeBlock(w=filterByBoolMask_7.in) { w; }
code_block_214 = CodeBlock { "БУДОВА_Уровень оборудования"; }
getParameterValueByName_56 = Element.GetParameterValueByName(element=code_block_213, parameterName=code_block_214)
code_block_215 = CodeBlock(a=getParameterValueByName_56) { a==""?"X":a; }
code_block_216 = CodeBlock { "Уровень"; }
getParameterValueByName_57 = Element.GetParameterValueByName(element=code_block_213, parameterName=code_block_216)
code_block_217 = CodeBlock(a=getParameterValueByName_57) { a.Name; }
code_block_218 = CodeBlock { 1; 2; }
substring_5 = String.Substring(str=code_block_217, startIndex=code_block_218.out0, length=code_block_218.out1)
replace_4 = String.Replace(string=code_block_215, searchFor=code_block_215, replaceWith=substring_5)
setParameterByName_39 = Element.SetParameterByName(element=code_block_213, parameterName=code_block_214, value=replace_4)
code_block_219 = CodeBlock { "БУДОВА_Этаж"; }
setParameterByName_40 = Element.SetParameterByName(element=setParameterByName_39, parameterName=code_block_219, value=code_block_217)

# group: Из уровней заполнили "БУДОВА_Уровень оборудования" (все экземпляры категории Электрооборудование)
code_block_220 = CodeBlock(w=filterByBoolMask_3.in) { w; }
code_block_221 = CodeBlock { "БУДОВА_Уровень оборудования"; }
getParameterValueByName_58 = Element.GetParameterValueByName(element=code_block_220, parameterName=code_block_221)
code_block_222 = CodeBlock(a=getParameterValueByName_58) { a==""?"X":a; }
code_block_223 = CodeBlock { "Уровень"; }
getParameterValueByName_59 = Element.GetParameterValueByName(element=code_block_220, parameterName=code_block_223)
code_block_224 = CodeBlock(a=getParameterValueByName_59) { a.Name; }
code_block_225 = CodeBlock { 1; 2; }
substring_6 = String.Substring(str=code_block_224, startIndex=code_block_225.out0, length=code_block_225.out1)
replace_5 = String.Replace(string=code_block_222, searchFor=code_block_222, replaceWith=substring_6)
setParameterByName_41 = Element.SetParameterByName(element=code_block_220, parameterName=code_block_221, value=replace_5)
code_block_226 = CodeBlock { "БУДОВА_Этаж"; }
setParameterByName_42 = Element.SetParameterByName(element=setParameterByName_41, parameterName=code_block_226, value=code_block_224)

code_block_227 = CodeBlock(М=filterByBoolMask_6.in) { М; }
code_block_228 = CodeBlock { "Уровень"; }
getParameterValueByName_60 = Element.GetParameterValueByName(element=code_block_227, parameterName=code_block_228)
code_block_229 = CodeBlock(a=getParameterValueByName_60) { a.Name; }
code_block_230 = CodeBlock { 1; 2; }
substring_7 = String.Substring(str=code_block_229, startIndex=code_block_230.out0, length=code_block_230.out1)

# group: Здесь удаляется 0 из 01 этажа пока не использую, сделано для будущего. Если нужно будет запустить - подключи после условия, а не после него
code_block_231 = CodeBlock { 0; 1; }
substring_8 = String.Substring(str=substring_7, startIndex=code_block_231.out0, length=code_block_231.out1)
code_block_232 = CodeBlock(a=substring_8) { a=="0"?"":a; }
code_block_233 = CodeBlock { 1; 1; }
substring_9 = String.Substring(str=substring_7, startIndex=code_block_233.out0, length=code_block_233.out1)

# group: Получили имена уровней
категория_уровни = CodeBlock { Category.ByName("OST_Levels"); }
all_elements_of_category_6 = ElementsOfCategory(Category=категория_уровни)
code_block_234 = CodeBlock(a=all_elements_of_category_6) { a.Name; }

# group: Задаем последовательность этажей по возрастанию
code_block_235 = CodeBlock { "LU"; "L0"; "L1"; "L2"; "L3"; "LT"; "LR"; }

# group: LU
contains_11 = String.Contains(str=code_block_234, searchFor=code_block_235.out0)
code_block_236 = CodeBlock { true; }
indexOf_9 = List.IndexOf(list=contains_11, element=code_block_236)

# group: L0
contains_12 = String.Contains(str=code_block_234, searchFor=code_block_235.out1)
code_block_237 = CodeBlock { true; }
allIndicesOf_8 = List.AllIndicesOf(list=contains_12, item=code_block_237)

# group: L1
contains_13 = String.Contains(str=code_block_234, searchFor=code_block_235.out2)
code_block_238 = CodeBlock { true; }
allIndicesOf_9 = List.AllIndicesOf(list=contains_13, item=code_block_238)

# group: L2
contains_14 = String.Contains(str=code_block_234, searchFor=code_block_235.out3)
code_block_239 = CodeBlock { true; }
allIndicesOf_10 = List.AllIndicesOf(list=contains_14, item=code_block_239)

# group: L3
contains_15 = String.Contains(str=code_block_234, searchFor=code_block_235.out4)
code_block_240 = CodeBlock { true; }
allIndicesOf_11 = List.AllIndicesOf(list=contains_15, item=code_block_240)

# group: LT
contains_16 = String.Contains(str=code_block_234, searchFor=code_block_235.out5)
code_block_241 = CodeBlock { true; }
allIndicesOf_12 = List.AllIndicesOf(list=contains_16, item=code_block_241)

# group: LR
contains_17 = String.Contains(str=code_block_234, searchFor=code_block_235.out6)
code_block_242 = CodeBlock { true; }
allIndicesOf_13 = List.AllIndicesOf(list=contains_17, item=code_block_242)

# group: Содали последовательность уровней по возрастанию этажей
list_create = List.Create(item0=indexOf_9, item1=allIndicesOf_8, item2=allIndicesOf_9, item3=allIndicesOf_10, item4=allIndicesOf_11, item5=allIndicesOf_12, item6=allIndicesOf_13)
flatten = List.Flatten(list=list_create)

# group: Смотреть список имен уровней
getItemAtIndex_9 = List.GetItemAtIndex(list=code_block_234, index=flatten)

code_block_243 = CodeBlock()
# ---------- code_block_243.designscript (31 lines) ----------
"М0";
"М1";
"М1";
"М1";
"М2";
"М2";
"М2";
"М3";
"М3";
"М3";
"М4";
"М4";
"М4";
"М5";
"М5";
"М5";
"М6";
"М6";
"М6";
"М7";
"М7";
"М7";
"М8";
"М8";
"М8";
"М9";
"М9";
"М9";
"М9";
"М9";
"М9";
# ----------------------------------------
list_create_2 = List.Create(item0=code_block_243.out0, item1=code_block_243.out1, item2=code_block_243.out2, item3=code_block_243.out3, item4=code_block_243.out4, item5=code_block_243.out5, item6=code_block_243.out6, item7=code_block_243.out7, item8=code_block_243.out8, item9=code_block_243.out9, item10=code_block_243.out10, item11=code_block_243.out11, item12=code_block_243.out12, item13=code_block_243.out13, item14=code_block_243.out14, item15=code_block_243.out15, item16=code_block_243.out16, item17=code_block_243.out17, item18=code_block_243.out18, item19=code_block_243.out19, item20=code_block_243.out20, item21=code_block_243.out21, item22=code_block_243.out22, item23=code_block_243.out23, item24=code_block_243.out24, item25=code_block_243.out25, item26=code_block_243.out26, item27=code_block_243.out27, item28=code_block_243.out28, item29=code_block_243.out29, item30=code_block_243.out30)  # graph output
byKeysValues_2 = DesignScript.Builtin.Dictionary.ByKeysValues(keys=getItemAtIndex_9, values=list_create_2)
code_block_244 = CodeBlock(dict=byKeysValues_2, a=code_block_229) { dict[a]; }
code_block_245 = CodeBlock(a=substring_8, b=substring_9) { a+b; }
code_block_246 = CodeBlock(M=code_block_244, Lev=code_block_245) { M + "-" + Lev; }

# group: Удаление всего что до знака "/"
code_block_247 = CodeBlock { "Имя панели"; }
getParameterValueByName_61 = Element.GetParameterValueByName(element=code_block_227, parameterName=code_block_247)
code_block_248 = CodeBlock { 0; }
code_block_249 = CodeBlock { "/"; }
indexOf_10 = String.IndexOf(str=getParameterValueByName_61, searchFor=code_block_249)
remove_12 = String.Remove(string=getParameterValueByName_61, startIndex=code_block_248, count=indexOf_10)

code_block_250 = CodeBlock(a=code_block_246, b=remove_12) { a+b; }

# group: Присвоили панели новое имя, в зависимости от уровня "БУДОВА_Группа" "БУДОВА_Уровень оборудования" "БУДОВА_Этаж"
code_block_251 = CodeBlock { "Имя панели"; }
setParameterByName_43 = Element.SetParameterByName(element=code_block_227, parameterName=code_block_251, value=code_block_250)
code_block_252 = CodeBlock { "БУДОВА_Группа"; }
setParameterByName_44 = Element.SetParameterByName(element=setParameterByName_43, parameterName=code_block_252, value=code_block_250)
code_block_253 = CodeBlock { "БУДОВА_Этаж"; }
setParameterByName_45 = Element.SetParameterByName(element=setParameterByName_43, parameterName=code_block_253, value=code_block_229)
code_block_254 = CodeBlock { "БУДОВА_Уровень оборудования"; }
setParameterByName_46 = Element.SetParameterByName(element=setParameterByName_43, parameterName=code_block_254, value=substring_7)

code_block_255 = CodeBlock { "БУДОВА_Этаж"; }

# group: восстановление имени уровня
code_block_256 = CodeBlock { 0; "L"; }
insert_31 = String.Insert(string=remove_8, index=code_block_256.out0, toInsert=code_block_256.out1)
length_11 = String.Length(str=insert_31)
code_block_257 = CodeBlock { "00"; }
insert_32 = String.Insert(string=insert_31, index=length_11, toInsert=code_block_257)

setParameterByName_47 = Element.SetParameterByName(element=setParameterByName_22, parameterName=code_block_255, value=insert_32)

# group: Категория пожарная сигнализация (заземление)
категория_электрические_приборы_3 = CodeBlock { Category.ByName("OST_FireAlarmDevices"); }  # frozen
all_elements_of_category_7 = ElementsOfCategory(Category=категория_электрические_приборы_3)

# group: Отобрали объекты, которые не связаны
code_block_258 = CodeBlock(w=all_elements_of_category_7) { w; }
code_block_259 = CodeBlock { "Рабочая плоскость"; }
getParameterValueByName_62 = Element.GetParameterValueByName(element=code_block_258, parameterName=code_block_259)
code_block_260 = CodeBlock(a=getParameterValueByName_62) { a=="<не связано>"?false:true; }
filterByBoolMask_25 = List.FilterByBoolMask(list=code_block_258, mask=code_block_260)
code_block_261 = CodeBlock(ф=filterByBoolMask_25.in) { ф; }

type = Object.Type(obj=getParameterValueByName_62)

# group: Категория кабельные лотки
категория_электрические_приборы_4 = CodeBlock { Category.ByName("OST_CableTray"); }  # frozen
all_elements_of_category_8 = ElementsOfCategory(Category=категория_электрические_приборы_4)

# group: "БУДОВА_Этаж" кабельных лотков
code_block_262 = CodeBlock(w=all_elements_of_category_8) { w; }
code_block_263 = CodeBlock { "БУДОВА_Этаж"; }
code_block_264 = CodeBlock { "Базовый уровень"; }
getParameterValueByName_63 = Element.GetParameterValueByName(element=code_block_262, parameterName=code_block_264)
code_block_265 = CodeBlock(a=getParameterValueByName_63) { a.Name; }
setParameterByName_48 = Element.SetParameterByName(element=code_block_262, parameterName=code_block_263, value=code_block_265)

# group: Категория соединительные детали кабельных лотков
категория_электрические_приборы_5 = CodeBlock { Category.ByName("OST_CableTrayFitting"); }  # frozen
all_elements_of_category_9 = ElementsOfCategory(Category=категория_электрические_приборы_5)

# group: "БУДОВА_Этаж" соединительных деталей кабельных лотков
code_block_266 = CodeBlock(w=all_elements_of_category_9) { w; }
code_block_267 = CodeBlock { "БУДОВА_Этаж"; }
code_block_268 = CodeBlock { "Уровень"; }
getParameterValueByName_64 = Element.GetParameterValueByName(element=code_block_266, parameterName=code_block_268)
code_block_269 = CodeBlock(a=getParameterValueByName_64) { a.Name; }
setParameterByName_49 = Element.SetParameterByName(element=code_block_266, parameterName=code_block_267, value=code_block_269)

# group: Категория соединительные детали коробов
категория_электрические_приборы_6 = CodeBlock { Category.ByName("OST_ConduitFitting"); }  # frozen
all_elements_of_category_10 = ElementsOfCategory(Category=категория_электрические_приборы_6)

# group: "БУДОВА_Этаж" соединительных деталей кабельных лотков
code_block_270 = CodeBlock(w=all_elements_of_category_10) { w; }
code_block_271 = CodeBlock { "БУДОВА_Этаж"; }
code_block_272 = CodeBlock { "Уровень"; }
getParameterValueByName_65 = Element.GetParameterValueByName(element=code_block_270, parameterName=code_block_272)
code_block_273 = CodeBlock(a=getParameterValueByName_65) { a.Name; }
setParameterByName_50 = Element.SetParameterByName(element=code_block_270, parameterName=code_block_271, value=code_block_273)

# group: Категория короба
категория_электрические_приборы_7 = CodeBlock { Category.ByName("OST_Conduit"); }
all_elements_of_category_11 = ElementsOfCategory(Category=категория_электрические_приборы_7)

# group: "БУДОВА_Этаж" кабельных лотков
code_block_274 = CodeBlock(w=all_elements_of_category_11) { w; }
code_block_275 = CodeBlock { "БУДОВА_Этаж"; }
code_block_276 = CodeBlock { "Базовый уровень"; }
getParameterValueByName_66 = Element.GetParameterValueByName(element=code_block_274, parameterName=code_block_276)
code_block_277 = CodeBlock(a=getParameterValueByName_66) { a.Name; }
setParameterByName_51 = Element.SetParameterByName(element=code_block_274, parameterName=code_block_275, value=code_block_277)

# group: "БУДОВА_Этаж" соединительных деталей кабельных лотков у которых есть рабочая плоскость
code_block_278 = CodeBlock(w=filterByBoolMask_25.in) { w; }
code_block_279 = CodeBlock { "БУДОВА_Этаж"; }
code_block_280 = CodeBlock { "Рабочая плоскость"; }
getParameterValueByName_67 = Element.GetParameterValueByName(element=code_block_278, parameterName=code_block_280)
code_block_281 = CodeBlock { "Уровень : "; ""; }
replace_6 = String.Replace(string=getParameterValueByName_67, searchFor=code_block_281.out0, replaceWith=code_block_281.out1)
setParameterByName_52 = Element.SetParameterByName(element=code_block_278, parameterName=code_block_279, value=replace_6)
getParameterValueByName_68 = Element.GetParameterValueByName(element=setParameterByName_52, parameterName=code_block_279)

code_block_282 = CodeBlock(a=filterByBoolMask_25.out) { a; }
code_block_283 = CodeBlock { "БУДОВА_Этаж"; }

# group: Получили уровни и их высотные отметки
категория_уровни_2 = CodeBlock { Category.ByName("OST_Levels"); }  # frozen
all_elements_of_category_12 = ElementsOfCategory(Category=категория_уровни_2)
elevation_2 = Level.Elevation(level=all_elements_of_category_12)

# group: Отобрали соответствующий отметке уровень
round_3 = Math.Round(number=elevation_2)

# group: Получили положение в прострастранстве и нашли середину Z
getLocation = Element.GetLocation(element=code_block_282)
code_block_284 = CodeBlock(a=getLocation) { a.EndPoint; }
code_block_285 = CodeBlock(a=code_block_284) { a.Z; }
code_block_286 = CodeBlock(a=getLocation) { a.StartPoint; }
code_block_287 = CodeBlock(a=code_block_286) { a.Z; }
code_block_288 = CodeBlock(Z1=code_block_285, Z2=code_block_287) { (Z1 + Z2)/2; }

# group: определили над какой высотной отметкой расположена Z элемента
python_script_3 = Python(IN[0]=code_block_288, IN[1]=round_3)  # IronPython2
# ---------- python_script_3.python (13 lines) ----------
z_levels = IN[1]

z_elements = IN[0]

diffs = []
for z_element in z_elements:
    difference = []
    for z_lev in z_levels:
        if (z_element - z_lev) >= 0:
            difference.append(z_element - z_lev)
    diffs.append(z_element - sorted(difference)[0])

OUT = diffs
# ----------------------------------------

# group (continued): Отобрали соответствующий отметке уровень
indexOf_11 = List.IndexOf(list=round_3, element=python_script_3)
getItemAtIndex_10 = List.GetItemAtIndex(list=all_elements_of_category_12, index=indexOf_11)
code_block_289 = CodeBlock(a=getItemAtIndex_10) { a.Name; }

setParameterByName_53 = Element.SetParameterByName(element=code_block_282, parameterName=code_block_283, value=code_block_289)
getParameterValueByName_69 = Element.GetParameterValueByName(element=setParameterByName_53, parameterName=code_block_283)

# group: Отобрали BDV_E000_Соединительную коробку труб наружного освещения сделана из категории Осветитльные приборы и потому вместо уровня "Рабочая плоскость"
code_block_290 = CodeBlock(a=all_elements_of_category_3) { a.Name; }
code_block_291 = CodeBlock { "BDV_E000_Cоединительная коробка (светильник наружного освещения)"; }
contains_18 = String.Contains(str=code_block_290, searchFor=code_block_291)
filterByBoolMask_26 = List.FilterByBoolMask(list=all_elements_of_category_3, mask=contains_18)

code_block_292 = CodeBlock(s=filterByBoolMask_26.in) { s; }
code_block_293 = CodeBlock { "БУДОВА_Этаж"; }
code_block_294 = CodeBlock { "Уровень"; }
getParameterValueByName_70 = Element.GetParameterValueByName(element=code_block_292, parameterName=code_block_294)
code_block_295 = CodeBlock(a=getParameterValueByName_70) { a.Name; }
setParameterByName_54 = Element.SetParameterByName(element=code_block_292, parameterName=code_block_293, value=code_block_295)
code_block_296 = CodeBlock { "БУДОВА_Уровень оборудования"; }
code_block_297 = CodeBlock { 1; 2; }
substring_10 = String.Substring(str=code_block_295, startIndex=code_block_297.out0, length=code_block_297.out1)
setParameterByName_55 = Element.SetParameterByName(element=code_block_292, parameterName=code_block_296, value=substring_10)
code_block_298 = CodeBlock(a=all_elements_of_category_3) { a.Id; }
code_block_299 = CodeBlock(a=code_block_298) { a==1632977; }
filterByBoolMask_27 = List.FilterByBoolMask(list=all_elements_of_category_3, mask=code_block_299)
parameters_2 = Element.Parameters(element=filterByBoolMask_26.in)

# group: Записали значение параметра "БУДОВА_Этаж" из родительских во вложенные семейства 1 и 2 уровня
python_script_4 = Python()  # IronPython2; frozen; unwired: IN[0]
# ---------- python_script_4.python (35 lines) ----------
# -*- coding: utf-8 -*
import clr
clr.AddReference('RevitAPI')
clr.AddReference('RevitServices')  # Работа с документом и транзакциями
from Autodesk.Revit import DB
from Autodesk.Revit.DB import FilteredElementCollector as FEC
from RevitServices.Persistence import DocumentManager as DM  # Менеджер документа

doc = DM.Instance.CurrentDBDocument # Получение файла документа
uiapp = DM.Instance.CurrentUIApplication
uidoc = uiapp.ActiveUIDocument

# получили родительские семейства из них найдем вложенные и перепишем уровни из родительских во вложенные
# метод GetSubComponentIds() находит только общие семейства, если галочка "Общий" в семействе не стоит
# пустые списки нужно исключить, видимо, пустые списки там где вложенное семейство не общее или
# нужно перебирать глубину вложенности
with DB.Transaction(doc, 'Этаж во вложенные семейства') as t:
    t.Start()
    # получили родительские семейства и списки ElementId вложенных в них (1 уровня вложения)
    fs = [[fam, fam.GetSubComponentIds()] for fam in FEC(doc).OfClass(DB.FamilyInstance) if fam.SuperComponent == None] 
    for f in fs:
        if f[0].LookupParameter('БУДОВА_Этаж'):  # если параметр есть
            if f[1]:  # если список не пустой
                for id_elem in f[1]:  # перебираем список из ElementId вложенных семейств
                    fm = doc.GetElement(id_elem)  # вложенное семейство (1 уровень вложенности) по его ElementId
                # присвоили значение параметра семейства 1 уровеня вложенности
                    fm_par = doc.GetElement(id_elem).LookupParameter('БУДОВА_Этаж').Set(f[0].LookupParameter('БУДОВА_Этаж').AsString())
                    if fm.GetSubComponentIds():  # проверяем еще один уровень вложенности
                        fams = fm.GetSubComponentIds()  # получили список ElementId еще одного уровня вложенности
                        if fams.Count == 1:  # если список ElementId из одного элемента
                            doc.GetElement(fams[0]).LookupParameter('БУДОВА_Этаж').Set(f[0].LookupParameter('БУДОВА_Этаж').AsString())  # получаем вложенное семейство (2 уровень вложенности) по его ElementId
                        else:
                            for fam in fams:  # если список ElementId из двух элементов
                                doc.GetElement(fam).LookupParameter('БУДОВА_Этаж').Set(f[0].LookupParameter('БУДОВА_Этаж').AsString())  # получаем вложенное семейство (2 уровень вложенности) по его ElementId
    t.Commit()
# ----------------------------------------

# group: Семейства, у которых не проставлен "БУДОВА_Этаж" в формате [Имя, Id]
python_script_5 = Python()  # IronPython2; frozen; unwired: IN[0]
# ---------- python_script_5.python (29 lines) ----------
# -*- coding: utf-8 -*
import clr
clr.AddReference('RevitAPI')
clr.AddReference('RevitServices')  # Работа с документом и транзакциями
from Autodesk.Revit import DB
from Autodesk.Revit.DB import FilteredElementCollector as FEC
from RevitServices.Persistence import DocumentManager as DM  # Менеджер документа

doc = DM.Instance.CurrentDBDocument # Получение файла документа
uiapp = DM.Instance.CurrentUIApplication
uidoc = uiapp.ActiveUIDocument

# получили родительские семейства из них найдем вложенные и перепишем уровни из родительских во вложенные
# метод GetSubComponentIds() находит только общие семейства, если галочка "Общий" в семействе не стоит
# пустые списки нужно исключить, видимо, пустые списки там где вложенное семейство не общее или
# нужно перебирать глубину вложенности
# получили родительские семейства и списки ElementId вложенных в них (1 уровня вложения)
fs = [[fam, fam.GetSubComponentIds()] for fam in FEC(doc).OfClass(DB.FamilyInstance) if fam.SuperComponent == None]  # получили родительские семейства и списки ElementId вложенных в них (1 уровня вложения)
no_mark = []

for f in fs:
    if f[0].LookupParameter('БУДОВА_Этаж'):  # если параметр есть
        in_no_mark = []
        if f[0].LookupParameter('БУДОВА_Этаж').AsString() == None:  # если параметр есть
            in_no_mark.append(f[0].Name)
            in_no_mark.append(f[0].Id)
            no_mark.append(in_no_mark)

OUT = no_mark
# ----------------------------------------

# group: восстановление имени уровня
code_block_300 = CodeBlock { 0; "L"; }
insert_33 = String.Insert(string=substring_2, index=code_block_300.out0, toInsert=code_block_300.out1)
length_12 = String.Length(str=insert_33)
code_block_301 = CodeBlock { "00"; }
insert_34 = String.Insert(string=insert_33, index=length_12, toInsert=code_block_301)

# group (continued): Для цепей КК
setParameterByName_56 = Element.SetParameterByName(element=code_block_166, parameterName=code_block_179, value=insert_34)

string = StringInput("C:\1 ИНЖИНИРИНГ\ОБЪЕКТЫ\078\Id\Id.xlsx")
now = DateTime.Now()
code_block_302 = CodeBlock { "dd.MM.yy_hhmm"; }
format = DateTime.Format(dateTime=now, format=code_block_302)
code_block_303 = CodeBlock { 0; }
string_from_array = FromArray(array=code_block_80)
boolean_7 = BoolSelector(true)
exportExcel = Data.ExportExcel(filePath=string, sheetName=format, startRow=code_block_303, startCol=code_block_303, data=string_from_array, overWrite=boolean_7)  # frozen
