# Dynamo graph BDV_E000_Переименование уровней 22.02.02.dyn (Dynamo 2.10.1.3976)

# group: Создание планов Получили все уровни
code_block = CodeBlock { Category.ByName("OST_Levels"); }
all_elements_of_category = ElementsOfCategory(Category=code_block)

byLevel = FloorPlanView.ByLevel(level=all_elements_of_category)
code_block_2 = CodeBlock { "Имя вида"; }
code_block_3 = CodeBlock { " "; ""; }
replace = String.Replace(searchFor=code_block_3.out0, replaceWith=code_block_3.out1)  # unwired: string
code_block_4 = CodeBlock { "Уровень"; ""; }
replace_2 = String.Replace(searchFor=code_block_4.out0, replaceWith=code_block_4.out1)  # unwired: string
code_block_5 = CodeBlock { "этаж"; ""; }
replace_3 = String.Replace(searchFor=code_block_5.out0, replaceWith=code_block_5.out1)  # unwired: string
function_compose = ComposeFunctions(func0=replace, func1=replace_2, func2=replace_3)
getParameterValueByName = Element.GetParameterValueByName(element=byLevel, parameterName=code_block_2)
function_apply = ApplyFunction(func=function_compose, arg1=getParameterValueByName)
code_block_6 = CodeBlock { 0; "E000-"; }
insert = String.Insert(string=function_apply, index=code_block_6.out0, toInsert=code_block_6.out1)
length = String.Length(str=insert)
code_block_7 = CodeBlock { "-Освещение"; }
insert_2 = String.Insert(string=insert, index=length, toInsert=code_block_7)
setParameterByName = Element.SetParameterByName(element=byLevel, parameterName=code_block_2, value=insert_2)
code_block_8 = CodeBlock { "БУДОВА_Раздел проекта"; "Освещение"; }
setParameterByName_2 = Element.SetParameterByName(element=setParameterByName, parameterName=code_block_8.out0, value=code_block_8.out1)
code_block_9 = CodeBlock { "Шаблон вида"; }

# group: Выберите!!! шаблон "es Отверстия"
выберите_шаблон_эл_планы = Views("BDV_E000_Освещение")  # "Выберите шаблон "ЭЛ_Планы отверстий""; graph input

setParameterByName_3 = Element.SetParameterByName(element=setParameterByName_2, parameterName=code_block_9, value=выберите_шаблон_эл_планы)
code_block_10 = CodeBlock { "Заголовок на листе"; }
code_block_11 = CodeBlock { 0; "План на уровне "; }
insert_3 = String.Insert(string=function_apply, index=code_block_11.out0, toInsert=code_block_11.out1)
setParameterByName_4 = Element.SetParameterByName(element=setParameterByName_3, parameterName=code_block_10, value=insert_3)

# group: является ли вид шаблоном
isViewTemplate = View.IsViewTemplate(view=выберите_шаблон_эл_планы)

# group: Получили все уровни
code_block_12 = CodeBlock { Category.ByName("OST_Levels"); }  # frozen
all_elements_of_category_2 = ElementsOfCategory(Category=code_block_12)

byLevel_2 = FloorPlanView.ByLevel(level=all_elements_of_category_2)
code_block_13 = CodeBlock { "Имя вида"; }
code_block_14 = CodeBlock { "этаж"; "Уровень "; }
replace_4 = String.Replace(searchFor=code_block_14.out0, replaceWith=code_block_14.out1)  # unwired: string
code_block_15 = CodeBlock { "Этаж"; "Уровень "; }
replace_5 = String.Replace(searchFor=code_block_15.out0, replaceWith=code_block_15.out1)  # unwired: string
code_block_16 = CodeBlock { "Техническийэтаж"; "Уровень 16"; }
replace_6 = String.Replace(searchFor=code_block_16.out0, replaceWith=code_block_16.out1)  # unwired: string
code_block_17 = CodeBlock { "Газоваякотельная,кровля"; "Уровень 17"; }
replace_7 = String.Replace(searchFor=code_block_17.out0, replaceWith=code_block_17.out1)  # unwired: string
code_block_18 = CodeBlock { "Кровля"; "18 Уровень"; }
replace_8 = String.Replace(searchFor=code_block_18.out0, replaceWith=code_block_18.out1)  # unwired: string
code_block_19 = CodeBlock { "Уровень 29 (Плита кровли котельной)"; "29 Уровень"; }
replace_9 = String.Replace(searchFor=code_block_19.out0, replaceWith=code_block_19.out1)  # unwired: string
code_block_20 = CodeBlock { "Подвал"; "-1 Уровень"; }
replace_10 = String.Replace(searchFor=code_block_20.out0, replaceWith=code_block_20.out1)  # unwired: string
code_block_21 = CodeBlock { "Уровень 27"; "27 Уровень"; }
replace_11 = String.Replace(searchFor=code_block_21.out0, replaceWith=code_block_21.out1)  # unwired: string
code_block_22 = CodeBlock { "Уровень 28"; "28 Уровень"; }
replace_12 = String.Replace(searchFor=code_block_22.out0, replaceWith=code_block_22.out1)  # unwired: string
function_compose_2 = ComposeFunctions(func0=replace_4, func1=replace_5, func2=replace_6, func3=replace_7, func4=replace_8, func5=replace_9, func6=replace_10, func7=replace_11, func8=replace_12)
getParameterValueByName_2 = Element.GetParameterValueByName(element=byLevel_2, parameterName=code_block_13)
function_apply_2 = ApplyFunction(func=function_compose_2, arg1=getParameterValueByName_2)

# group: Сначала заморозь потом подбирай строки
setParameterByName_5 = Element.SetParameterByName(element=byLevel_2, parameterName=code_block_13, value=function_apply_2)  # frozen

code_block_23 = CodeBlock(a=getParameterValueByName_2) { a[17]; }

# group: Переименование уровней Получили все уровни
code_block_24 = CodeBlock { Category.ByName("OST_Levels"); }  # frozen
all_elements_of_category_3 = ElementsOfCategory(Category=code_block_24)

code_block_25 = CodeBlock { "Имя"; }
code_block_26 = CodeBlock { "Уровень 1"; "Этаж 1"; "1 этаж"; "L0100"; }
replace_13 = String.Replace(searchFor=code_block_26.out0, replaceWith=code_block_26.out3)  # unwired: string
code_block_27 = CodeBlock { "Уровень 2"; "Этаж 2"; "2 этаж"; "L0200"; }
replace_14 = String.Replace(searchFor=code_block_27.out0, replaceWith=code_block_27.out3)  # unwired: string
code_block_28 = CodeBlock { "Уровень 3"; "Этаж 3"; "3 этаж"; "L0300"; }
replace_15 = String.Replace(searchFor=code_block_28.out0, replaceWith=code_block_28.out3)  # unwired: string
code_block_29 = CodeBlock { "Уровень 4"; "Этаж 4"; "4 этаж"; "L0400"; }
replace_16 = String.Replace(searchFor=code_block_29.out0, replaceWith=code_block_29.out3)  # unwired: string
code_block_30 = CodeBlock { "Уровень 5"; "Этаж 5"; "5 этаж"; "L0500"; }
replace_17 = String.Replace(searchFor=code_block_30.out0, replaceWith=code_block_30.out3)  # unwired: string
code_block_31 = CodeBlock { "Уровень 6"; "Этаж 6"; "6 этаж"; "L0600"; }
replace_18 = String.Replace(searchFor=code_block_31.out0, replaceWith=code_block_31.out3)  # unwired: string
code_block_32 = CodeBlock { "Уровень 7"; "Этаж 7"; "7 этаж"; "L0700"; }
replace_19 = String.Replace(searchFor=code_block_32.out0, replaceWith=code_block_32.out3)  # unwired: string
code_block_33 = CodeBlock { "Уровень 8"; "Этаж 8"; "8 этаж"; "L0800"; }
replace_20 = String.Replace(searchFor=code_block_33.out0, replaceWith=code_block_33.out3)  # unwired: string
code_block_34 = CodeBlock { "Уровень 9"; "Этаж 9"; "9 этаж"; "L0900"; }
replace_21 = String.Replace(searchFor=code_block_34.out0, replaceWith=code_block_34.out3)  # unwired: string
function_compose_3 = ComposeFunctions(function0=replace_13, function1=replace_14, function2=replace_15, function3=replace_16, function4=replace_17, function5=replace_18, function6=replace_19, function7=replace_20, function8=replace_21)
code_block_35 = CodeBlock { "Уровень 10"; "Этаж 10"; "10 этаж"; "L1000"; }
replace_22 = String.Replace(searchFor=code_block_35.out1, replaceWith=code_block_35.out3)  # unwired: string
code_block_36 = CodeBlock { "Уровень 11"; "Этаж 11"; "11 этаж"; "L1100"; }
replace_23 = String.Replace(searchFor=code_block_36.out1, replaceWith=code_block_36.out3)  # unwired: string
code_block_37 = CodeBlock { "Уровень 12"; "Этаж 12"; "12 этаж"; "E000-L1200"; }
replace_24 = String.Replace(searchFor=code_block_37.out0, replaceWith=code_block_37.out3)  # unwired: string
code_block_38 = CodeBlock { "Уровень 13"; "Этаж 13"; "13 этаж"; "L1300"; }
replace_25 = String.Replace(searchFor=code_block_38.out0, replaceWith=code_block_38.out3)  # unwired: string
code_block_39 = CodeBlock { "Уровень 14"; "Этаж 14"; "14 этаж"; "L1400"; }
replace_26 = String.Replace(searchFor=code_block_39.out0, replaceWith=code_block_39.out3)  # unwired: string
code_block_40 = CodeBlock { "Уровень 15"; "Этаж 15"; "15 этаж"; "L1500"; }
replace_27 = String.Replace(searchFor=code_block_40.out0, replaceWith=code_block_40.out3)  # unwired: string
code_block_41 = CodeBlock { "Уровень 16"; "Этаж 16 технический"; "16 этаж"; "LT100"; }
replace_28 = String.Replace(searchFor=code_block_41.out0, replaceWith=code_block_41.out3)  # unwired: string
code_block_42 = CodeBlock { "Уровень 17"; "Этаж 17"; "17 этаж"; "L1700"; }
replace_29 = String.Replace(searchFor=code_block_42.out0, replaceWith=code_block_42.out3)  # unwired: string
code_block_43 = CodeBlock { "Уровень 18"; "Этаж 18"; "18 этаж"; "L1800"; }
replace_30 = String.Replace(searchFor=code_block_43.out0, replaceWith=code_block_43.out3)  # unwired: string
code_block_44 = CodeBlock { "Уровень 19"; "Этаж 19"; "19 этаж"; "L1900"; }
replace_31 = String.Replace(searchFor=code_block_44.out0, replaceWith=code_block_44.out3)  # unwired: string
code_block_45 = CodeBlock { "Уровень 20"; "Этаж 20"; "20 этаж"; "L2000"; }
replace_32 = String.Replace(searchFor=code_block_45.out0, replaceWith=code_block_45.out3)  # unwired: string
code_block_46 = CodeBlock { "Уровень 21"; "Этаж 21"; "21 этаж"; "L2100"; }
replace_33 = String.Replace(searchFor=code_block_46.out0, replaceWith=code_block_46.out3)  # unwired: string
code_block_47 = CodeBlock { "Уровень 22"; "Этаж 22"; "22 этаж"; "L2200"; }
replace_34 = String.Replace(searchFor=code_block_47.out0, replaceWith=code_block_47.out2)  # unwired: string
code_block_48 = CodeBlock { "Уровень 23"; "Этаж 23"; "23 этаж"; "L2300"; }
replace_35 = String.Replace(searchFor=code_block_48.out0, replaceWith=code_block_48.out3)  # unwired: string
code_block_49 = CodeBlock { "Уровень 24"; "Этаж 24"; "24 этаж"; "L2400"; }
replace_36 = String.Replace(searchFor=code_block_49.out0, replaceWith=code_block_49.out3)  # unwired: string
code_block_50 = CodeBlock { "Уровень 25"; "Этаж 25"; "25 этаж"; "LT100"; }
replace_37 = String.Replace(searchFor=code_block_50.out0, replaceWith=code_block_50.out3)  # unwired: string
code_block_51 = CodeBlock { "Уровень 26"; "Этаж 26"; "26 этаж"; "LR100"; }
replace_38 = String.Replace(searchFor=code_block_51.out0, replaceWith=code_block_51.out3)  # unwired: string
code_block_52 = CodeBlock { "Уровень -1"; "Этаж -1"; "-1 этаж"; "LU100"; }
replace_39 = String.Replace(searchFor=code_block_52.out0, replaceWith=code_block_52.out3)  # unwired: string
code_block_53 = CodeBlock { "Уровень 26_1"; "Этаж 26_1"; "26_1 этаж"; "LR200"; }
replace_40 = String.Replace(searchFor=code_block_53.out0, replaceWith=code_block_53.out3)  # unwired: string
code_block_54 = CodeBlock { "Уровень 26_2"; "Этаж 26_2"; "26_2 этаж"; "LR300"; }
replace_41 = String.Replace(searchFor=code_block_54.out0, replaceWith=code_block_54.out3)  # unwired: string
code_block_55 = CodeBlock { "27 этаж"; "LR400"; }
replace_42 = String.Replace(searchFor=code_block_55.out0, replaceWith=code_block_55.out1)  # unwired: string
function_compose_4 = ComposeFunctions(function0=replace_22, function1=replace_23, function2=replace_24, function3=replace_25, function4=replace_26, function5=replace_27, function6=replace_28, function7=replace_29, function8=replace_30, function9=replace_31, function10=replace_32, function11=replace_33, function12=replace_34, function13=replace_35, function14=replace_36, function15=replace_37, function16=replace_38, function17=replace_39, function18=replace_40, function19=replace_41, function20=replace_42)
getParameterValueByName_3 = Element.GetParameterValueByName(element=all_elements_of_category_3, parameterName=code_block_25)
code_block_56 = CodeBlock { "Уровень 26_1"; "LR200"; }
replace_43 = String.Replace(string=getParameterValueByName_3, searchFor=code_block_56.out0, replaceWith=code_block_56.out1)
function_apply_3 = ApplyFunction(function=function_compose_4, argument0=replace_43)
function_apply_4 = ApplyFunction(function=function_compose_3, argument0=function_apply_3)
setParameterByName_6 = Element.SetParameterByName(element=all_elements_of_category_3, parameterName=code_block_25, value=function_apply_4)

# group: Переименование планов Выбери ViewPlan
element_types = ElementTypes("ViewPlan")  # frozen
all_elements_of_type = ElementsOfType(element_type=element_types)

isViewTemplate_2 = View.IsViewTemplate(view=all_elements_of_type)
filterByBoolMask = List.FilterByBoolMask(list=all_elements_of_type, mask=isViewTemplate_2)
code_block_57 = CodeBlock { "Имя вида"; }
code_block_58 = CodeBlock { "1 этаж"; "E000-L0100"; }
replace_44 = String.Replace(searchFor=code_block_58.out0, replaceWith=code_block_58.out1)  # unwired: string
code_block_59 = CodeBlock { "2 этаж"; "E000-L0200"; }
replace_45 = String.Replace(searchFor=code_block_59.out0, replaceWith=code_block_59.out1)  # unwired: string
code_block_60 = CodeBlock { "3 этаж"; "E000-L0300"; }
replace_46 = String.Replace(searchFor=code_block_60.out0, replaceWith=code_block_60.out1)  # unwired: string
code_block_61 = CodeBlock { "4 этаж"; "E000-L0400"; }
replace_47 = String.Replace(searchFor=code_block_61.out0, replaceWith=code_block_61.out1)  # unwired: string
code_block_62 = CodeBlock { "5 этаж"; "E000-L0500"; }
replace_48 = String.Replace(searchFor=code_block_62.out0, replaceWith=code_block_62.out1)  # unwired: string
code_block_63 = CodeBlock { "6 этаж"; "E000-L0600"; }
replace_49 = String.Replace(searchFor=code_block_63.out0, replaceWith=code_block_63.out1)  # unwired: string
code_block_64 = CodeBlock { "7 этаж"; "E000-L0700"; }
replace_50 = String.Replace(searchFor=code_block_64.out0, replaceWith=code_block_64.out1)  # unwired: string
code_block_65 = CodeBlock { "8 этаж"; "E000-L0800"; }
replace_51 = String.Replace(searchFor=code_block_65.out0, replaceWith=code_block_65.out1)  # unwired: string
code_block_66 = CodeBlock { "9 этаж"; "E000-L0900"; }
replace_52 = String.Replace(searchFor=code_block_66.out0, replaceWith=code_block_66.out1)  # unwired: string
function_compose_5 = ComposeFunctions(function0=replace_44, function1=replace_45, function2=replace_46, function3=replace_47, function4=replace_48, function5=replace_49, function6=replace_50, function7=replace_51, function8=replace_52)
code_block_67 = CodeBlock { "10 этаж"; "E000-L1000"; }
replace_53 = String.Replace(searchFor=code_block_67.out0, replaceWith=code_block_67.out1)  # unwired: string
code_block_68 = CodeBlock { "11 этаж"; "E000-L1100"; }
replace_54 = String.Replace(searchFor=code_block_68.out0, replaceWith=code_block_68.out1)  # unwired: string
code_block_69 = CodeBlock { "12 этаж"; "E000-L1200"; }
replace_55 = String.Replace(searchFor=code_block_69.out0, replaceWith=code_block_69.out1)  # unwired: string
code_block_70 = CodeBlock { "13 этаж"; "E000-L1300"; }
replace_56 = String.Replace(searchFor=code_block_70.out0, replaceWith=code_block_70.out1)  # unwired: string
code_block_71 = CodeBlock { "14 этаж"; "E000-L1400"; }
replace_57 = String.Replace(searchFor=code_block_71.out0, replaceWith=code_block_71.out1)  # unwired: string
code_block_72 = CodeBlock { "15 этаж"; "E000-L1500"; }
replace_58 = String.Replace(searchFor=code_block_72.out0, replaceWith=code_block_72.out1)  # unwired: string
code_block_73 = CodeBlock { "16 этаж"; "E000-L1600"; }
replace_59 = String.Replace(searchFor=code_block_73.out0, replaceWith=code_block_73.out1)  # unwired: string
code_block_74 = CodeBlock { "17 этаж"; "E000-L1700"; }
replace_60 = String.Replace(searchFor=code_block_74.out0, replaceWith=code_block_74.out1)  # unwired: string
code_block_75 = CodeBlock { "18 этаж"; "E000-L1800"; }
replace_61 = String.Replace(searchFor=code_block_75.out0, replaceWith=code_block_75.out1)  # unwired: string
code_block_76 = CodeBlock { "19 этаж"; "E000-L1900"; }
replace_62 = String.Replace(searchFor=code_block_76.out0, replaceWith=code_block_76.out1)  # unwired: string
code_block_77 = CodeBlock { "20 этаж"; "E000-L2000"; }
replace_63 = String.Replace(searchFor=code_block_77.out0, replaceWith=code_block_77.out1)  # unwired: string
code_block_78 = CodeBlock { "21 этаж"; "E000-L2100"; }
replace_64 = String.Replace(searchFor=code_block_78.out0, replaceWith=code_block_78.out1)  # unwired: string
code_block_79 = CodeBlock { "22 этаж"; "E000-L2200"; }
replace_65 = String.Replace(searchFor=code_block_79.out0, replaceWith=code_block_79.out1)  # unwired: string
code_block_80 = CodeBlock { "23 этаж"; "E000-L2300"; }
replace_66 = String.Replace(searchFor=code_block_80.out0, replaceWith=code_block_80.out1)  # unwired: string
code_block_81 = CodeBlock { "24 этаж"; "E000-L2400"; }
replace_67 = String.Replace(searchFor=code_block_81.out0, replaceWith=code_block_81.out1)  # unwired: string
code_block_82 = CodeBlock { "25 этаж"; "E000-LT100"; }
replace_68 = String.Replace(searchFor=code_block_82.out0, replaceWith=code_block_82.out1)  # unwired: string
code_block_83 = CodeBlock { "26 этаж"; "E000-LR100"; }
replace_69 = String.Replace(searchFor=code_block_83.out0, replaceWith=code_block_83.out1)  # unwired: string
code_block_84 = CodeBlock { "-1 этаж"; "E000-LU100"; }
replace_70 = String.Replace(searchFor=code_block_84.out0, replaceWith=code_block_84.out1)  # unwired: string
code_block_85 = CodeBlock { "26_1 этаж"; "E000-LR200"; }
replace_71 = String.Replace(searchFor=code_block_85.out0, replaceWith=code_block_85.out1)  # unwired: string
code_block_86 = CodeBlock { "26_2 этаж"; "E000-LR300"; }
replace_72 = String.Replace(searchFor=code_block_86.out0, replaceWith=code_block_86.out1)  # unwired: string
code_block_87 = CodeBlock { "27 этаж"; "E000-LR400"; }
replace_73 = String.Replace(searchFor=code_block_87.out0, replaceWith=code_block_87.out1)  # unwired: string
function_compose_6 = ComposeFunctions(function0=replace_53, function1=replace_54, function2=replace_55, function3=replace_56, function4=replace_57, function5=replace_58, function6=replace_59, function7=replace_60, function8=replace_61, function9=replace_62, function10=replace_63, function11=replace_64, function12=replace_65, function13=replace_66, function14=replace_67, function15=replace_68, function16=replace_69, function17=replace_70, function18=replace_71, function19=replace_72, function20=replace_73)
getParameterValueByName_4 = Element.GetParameterValueByName(element=filterByBoolMask.out, parameterName=code_block_57)
function_apply_5 = ApplyFunction(function=function_compose_6, argument0=getParameterValueByName_4)
function_apply_6 = ApplyFunction(function=function_compose_5, argument0=function_apply_5)
code_block_88 = CodeBlock { ". "; "-"; }
replace_74 = String.Replace(string=function_apply_6, searchFor=code_block_88.out0, replaceWith=code_block_88.out1)
setParameterByName_7 = Element.SetParameterByName(element=filterByBoolMask.out, parameterName=code_block_57, value=replace_74)
